# Dynamo graph PlantasEM_script.dyn (Dynamo 2.16.1.2727)
# packages: Data-Shapes 2022.2.96, WombatDynamo 2.3.4, Orchid 200.4.0.7938, Clockwork for Dynamo 2.x 2.4.0, Data-Shapes 2021.2.94, Genius Loci 2020.8.3, archi-lab.net 2022.210.2419, Crumple 2022.2.13

view_family_types_ᶜᵒⁿᵛᵉʳᵗᵉᵈ = CodeBlock()  # "View Family Types ⁽ᶜᵒⁿᵛᵉʳᵗᵉᵈ ᵈʳᵒᵖᵈᵒʷⁿ⁾"
# ---------- view_family_types_ᶜᵒⁿᵛᵉʳᵗᵉᵈ.designscript (2 lines) ----------
//Building Section;
Revit.Elements.ElementSelector.ByElementId(69334);
# ----------------------------------------
code_block = CodeBlock { "Vistas Estructura Metalica"; }
code_block_2 = CodeBlock()
# ---------- code_block_2.designscript (6 lines) ----------
"INICIAR";
"CANCELAR";
//Label
120;
//Width
450;
# ----------------------------------------
code_block_3 = CodeBlock { "Niveles:"; }
code_block_4 = CodeBlock { "Levels"; }
byName = Category.ByName(name=code_block_4)
all_elements_of_category = ElementsOfCategory(Category=byName)
elevation = Level.Elevation(level=all_elements_of_category)
sortByKey = List.SortByKey(list=all_elements_of_category, keys=elevation)
code_block_5 = CodeBlock { "Building Story"; }
getParameterValueByName = Element.GetParameterValueByName(element=sortByKey.sortedList, parameterName=code_block_5)
code_block_6 = CodeBlock { 1; }
eq = getParameterValueByName == code_block_6
filterByBoolMask = List.FilterByBoolMask(list=sortByKey.sortedList, mask=eq)
name = Element.Name(element=filterByBoolMask.in)
code_block_7 = CodeBlock()
# ---------- code_block_7.designscript (8 lines) ----------
//Height
360;
//elemCount
true;
//sort
false;
//id
false;
# ----------------------------------------
code_block_8 = CodeBlock(l=name) { count = DSCore.List.Count(l) - 1; 0..count..1; }
listview_data = Custom[Listview Data](InputName=code_block_3, Keys=name, Values=filterByBoolMask.in, Height_optionnal=code_block_7.out0, ShowElementCount_optionnal=code_block_7.out1, DefaultValueIndices_optionnal=code_block_8.out1, SortItems_optionnal=code_block_7.out2, ShowId_optionnal=code_block_7.out3)  # package Data-Shapes; Create data for ListView input in UI.MultiInputForm ++ . Check out www.data-shapes.net for more infos.
code_block_9 = CodeBlock { "Escala:"; }
code_block_10 = CodeBlock()
# ---------- code_block_10.designscript (10 lines) ----------
[
"1:50",
"1:75",
"1:100",
"1:125",
"1:150",
"1:175",
"1:200"
];
":";
# ----------------------------------------
split = String.Split(string=code_block_10.out0, separator0=code_block_10.out1)
code_block_11 = CodeBlock { 1; }
getItemAtIndex = List.GetItemAtIndex(list=split@L2, index=code_block_11)
toNumber = String.ToNumber(string=getItemAtIndex)
code_block_12 = CodeBlock { 0; false; }
dropdown_data = Custom[DropDown Data](InputName=code_block_9, Keys=code_block_10.out0, Values=toNumber, DefaultValueIndex=code_block_12.out0, Sorted_optional=code_block_12.out1)  # package Data-Shapes; Create data for DropDown input in UI.MultiInputForm ++ . Check out www.data-shapes.net for more infos.
code_block_13 = CodeBlock { "Nombre Estructura:"; "Ejemplo, TECHUMBRE"; }
textbox_data = Custom[TextBox Data](InputName=code_block_13.out0, DefaultText=code_block_13.out1)  # package Data-Shapes; Create Data for TextBox input in UI.MultipleInputForm ++ . Check out www.data-shapes.net for more informations
code_block_14 = CodeBlock()
# ---------- code_block_14.designscript (2 lines) ----------
"Importante:";
"El nombre de la Estructura debe ser único. Si ya existe, por ejemplo, la Estructura Cubierta, usar un nombre diferente.";
# ----------------------------------------
textnote_data = Custom[TextNote Data](Title=code_block_14.out0, TextNote=code_block_14.out1)  # package Data-Shapes; Create Data for TextNote input in UI.MultipleInputForm ++ . Check out www.data-shapes.net for more informations
list_create = List.Create(item0=textbox_data, item1=textnote_data)
inputgroup_data = Custom[InputGroup Data](Inputs=list_create)  # package Data-Shapes; Creates a group of inputs for UI.MultipleInputForm ++ . Check out www.data-shapes.net for more infos !
list_create_2 = List.Create(item0=listview_data, item1=dropdown_data, item2=inputgroup_data)
boolean = BoolSelector(true)
multipleinputform = Custom[MultipleInputForm ++](Description_optional=code_block, ButtonText_optional=code_block_2.out0, Inputs=list_create_2, Toggle=boolean, CancelButtonText_optional=code_block_2.out1, Width_optional=code_block_2.out3, LabelWidth_optional=code_block_2.out2)  # package Data-Shapes; Create a form with multiple inputs. see www.data-shapes.net for tutorials and infos!
code_block_15 = CodeBlock(l=multipleinputform.User_Inputs)
# ---------- code_block_15.designscript (12 lines) ----------
l;
[Imperative]
{
	if (l == null)
		{
		return = [[],[],[]];
		}
	else
		{
		return = l;
		}
};
# ----------------------------------------
code_block_16 = CodeBlock(l=code_block_15.out1) { DSCore.List.Flatten(([l[0]]),1); }
nullToEmptyList = WombatDynamo.List.NullToEmptyList(data=code_block_16)
byLevel = StructuralPlanView.ByLevel(level=nullToEmptyList)
code_block_17 = CodeBlock { "Zona"; }
code_block_18 = CodeBlock(l=code_block_15.out1) { DSCore.String.ToUpper(DSCore.List.Flatten(([l[2]]),1)); }
setParameterByName = Element.SetParameterByName(element=byLevel, parameterName=code_block_17, value=code_block_18, lacing=Longest)
view_family_types_ᶜᵒⁿᵛᵉʳᵗᵉᵈ_2 = CodeBlock()  # "View Family Types ⁽ᶜᵒⁿᵛᵉʳᵗᵉᵈ ᵈʳᵒᵖᵈᵒʷⁿ⁾"
# ---------- view_family_types_ᶜᵒⁿᵛᵉʳᵗᵉᵈ_2.designscript (3 lines) ----------
//Structural Plan (Piso);
Revit.Elements.ElementSelector.ByElementId(92026);
"Type";
# ----------------------------------------
setParameterByName_2 = Element.SetParameterByName(element=setParameterByName, parameterName=view_family_types_ᶜᵒⁿᵛᵉʳᵗᵉᵈ_2.out1, value=view_family_types_ᶜᵒⁿᵛᵉʳᵗᵉᵈ_2.out0)
code_block_19 = CodeBlock(l=code_block_15.out1) { DSCore.List.Flatten(([l[1]]),1); }
nullToEmptyList_2 = WombatDynamo.List.NullToEmptyList(data=code_block_19)
setScale = View.SetScale(view=setParameterByName_2, scale=nullToEmptyList_2, lacing=Longest)
code_block_20 = CodeBlock { null; }
replaceEmptyLists = Custom[List.ReplaceEmptyLists](seq=setScale, Replacement=code_block_20)  # package Clockwork for Dynamo 2.x; Replaces all empty lists within a given list with a substitute
all = Orchid.RevitProject.Views.ViewTemplate.InDocument()  # "ViewTemplate.All"
flatten = List.Flatten(list=all.ViewTemplate)
name_2 = Element.Name(element=flatten)
code_block_21 = CodeBlock { "Structural Foundation Plan"; }
eq_2 = name_2 == code_block_21
filterByBoolMask_2 = List.FilterByBoolMask(list=flatten, mask=eq_2)
code_block_22 = CodeBlock(x=replaceEmptyLists, y=filterByBoolMask_2.in)
# ---------- code_block_22.designscript (14 lines) ----------
x;
y;

[Imperative]
{
	if (x == null)
		{
		return = [];
		}
	else
		{
		return = y;
		}
};
# ----------------------------------------
code_block_23 = CodeBlock(x=setScale) { esc = DSCore.List.UniqueItems(x.GetParameterValueByName("Zona")); "01_ENTREGABLE_05_EM_STRUCTURAL PLAN (PISO)_"+esc; }
duplicate = Orchid.RevitProject.Views.ViewTemplate.Duplicate(viewTemplate=code_block_22.out2, name=code_block_23.out1)
code_block_24 = CodeBlock(esc=code_block_23.esc)
# ---------- code_block_24.designscript (13 lines) ----------
DSCore.List.Flatten(
[
"Clasificacion",
"Subclasificacion",
"Zona"
]);

DSCore.List.Flatten(
[
"01_ENTREGABLE",
"05_EM",
esc
]);
# ----------------------------------------
setParameterByName_3 = Element.SetParameterByName(element=duplicate, parameterName=code_block_24.out0, value=code_block_24.out1, lacing=Longest)
uniqueItems = List.UniqueItems(list=setParameterByName_3)
code_block_25 = CodeBlock { null; }
replaceEmptyLists_2 = Custom[List.ReplaceEmptyLists](seq=uniqueItems, Replacement=code_block_25)
code_block_26 = CodeBlock { null; }
replaceEmptyLists_3 = Custom[List.ReplaceEmptyLists](seq=setParameterByName_3, Replacement=code_block_26)
code_block_27 = CodeBlock(x=replaceEmptyLists_3)
# ---------- code_block_27.designscript (13 lines) ----------
x;

[Imperative]
{
	if (x == null)
		{
		return = [[]];
		}
	else
		{
		return = x;
		}
};
# ----------------------------------------
code_block_28 = CodeBlock(a=code_block_27.out1)
# ---------- code_block_28.designscript (6 lines) ----------
esc = DSCore.List.UniqueItems(a.GetParameterValueByName("Zona"))[0];

["Zona","Subclasificacion"];
["NotEquals","NotEquals"];
[esc,"05_EM"];
"05_EM_"+esc;
# ----------------------------------------
code_block_29 = CodeBlock(x=replaceEmptyLists_2, y=code_block_28.out4)  # same code as code_block_22
create = Orchid.RevitProject.Filters.FilterRule.Create(parameter=code_block_28.out1, ruleType=code_block_28.out2, value=code_block_28.out3)
code_block_30 = CodeBlock { "Sections"; }
byName_2 = Category.ByName(name=code_block_30)
byRule = Orchid.RevitProject.Filters.ParameterFilter.Create(name=code_block_29.out2@L1, filterRule=create@L2, category=byName_2@L1, lacing=Longest)  # "ParameterFilter.ByRule"
code_block_31 = CodeBlock { false; }
addFilter = Orchid.RevitProject.Views.View.AddFilter(view=uniqueItems, parameterFilter=byRule, visibility=code_block_31, lacing=Longest)
set = Orchid.RevitProject.Views.ViewTemplate.Set(view=setScale, viewTemplate=addFilter, lacing=Longest)
code_block_32 = CodeBlock { "View Name"; }
identity = Object.Identity(object=set)
code_block_33 = CodeBlock()
# ---------- code_block_33.designscript (4 lines) ----------
[
"Type",
"Subclasificacion"
];
# ----------------------------------------
getParameterValueByName_2 = Element.GetParameterValueByName(element=identity@L1, parameterName=code_block_33@L2, lacing=Longest)
code_block_34 = CodeBlock { null; }
replaceEmptyLists_4 = Custom[List.ReplaceEmptyLists](seq=getParameterValueByName_2, Replacement=code_block_34)
code_block_35 = CodeBlock(x=replaceEmptyLists_4, y=getParameterValueByName_2)
# ---------- code_block_35.designscript (14 lines) ----------
x;
y;

[Imperative]
{
	if (x == null)
		{
		return = [null,null];
		}
	else
		{
		return = y;
		}
};
# ----------------------------------------
code_block_36 = CodeBlock { 1; }
getItemAtIndex_2 = List.GetItemAtIndex(list=code_block_35.out2@L2, index=code_block_36)
code_block_37 = CodeBlock { "_"; }
code_block_38 = CodeBlock { 0; }
getItemAtIndex_3 = List.GetItemAtIndex(list=code_block_35.out2@L2, index=code_block_38)
nullToEmptyList_3 = WombatDynamo.List.NullToEmptyList(data=getItemAtIndex_3)
name_3 = Element.Name(element=nullToEmptyList_3)
code_block_39 = CodeBlock { 0; 17; }
remove = String.Remove(string=name_3, startIndex=code_block_39.out0, count=code_block_39.out1)
code_block_40 = CodeBlock { ")"; ""; }
replace = String.Replace(string=remove, searchFor=code_block_40.out0, replaceWith=code_block_40.out1)
toUpper = String.ToUpper(string=replace)
name_4 = Element.Name(element=identity)
code_block_41 = CodeBlock { "Zona"; }
getParameterValueByName_3 = Element.GetParameterValueByName(element=identity, parameterName=code_block_41)
list_create_3 = List.Create(item0=getItemAtIndex_2, item1=toUpper, item2=name_4, item3=getParameterValueByName_3)
transpose = List.Transpose(lists=list_create_3)
join = String.Join(separator=code_block_37, string0=transpose@L2)
code_block_42 = CodeBlock(x=getItemAtIndex_2, y=join)
# ---------- code_block_42.designscript (14 lines) ----------
x;
y;

[Imperative]
{
	if (x[0] == null)
		{
		return = [];
		}
	else
		{
		return = y;
		}
};
# ----------------------------------------
code_block_43 = CodeBlock { 0; 3; }
remove_2 = String.Remove(string=code_block_42.out2, startIndex=code_block_43.out0, count=code_block_43.out1)
setParameterByName_4 = Element.SetParameterByName(element=set, parameterName=code_block_32, value=remove_2)
element_level = Custom[Element Level](element=setParameterByName_4)  # package Genius Loci; Gets an element's level. Based on a Clockwork's node
code_block_44 = CodeBlock { 750; -1500; }
set_viewrange = Custom[Set ViewRange](view=setParameterByName_4, TopLevel=element_level, Top=code_block_44.out0, CutLevel=element_level, CutPlane=code_block_44.out0, BottomLevel=element_level, Bottom=code_block_44.out1, DepthLevel=element_level, ViewDepth=code_block_44.out1, lacing=Longest)  # package Genius Loci; Set the view range of the given plan view.
code_block_45 = CodeBlock { "Title on Sheet"; }
name_5 = Element.Name(element=set_viewrange)
code_block_46 = CodeBlock { "_"; }
split_2 = String.Split(string=name_5, separator0=code_block_46)
code_block_47 = CodeBlock { null; }
replaceEmptyLists_5 = Custom[List.ReplaceEmptyLists](seq=split_2, Replacement=code_block_47)
code_block_48 = CodeBlock(x=replaceEmptyLists_5, y=split_2)
# ---------- code_block_48.designscript (14 lines) ----------
x;
y;

[Imperative]
{
	if (x == null)
		{
		return = [null,null,null,null];
		}
	else
		{
		return = y;
		}
};
# ----------------------------------------
code_block_49 = CodeBlock { 2; }
getItemAtIndex_4 = List.GetItemAtIndex(list=code_block_48.out2@L2, index=code_block_49)
code_block_50 = CodeBlock(nivel=getItemAtIndex_4) { title = "PLANTA PLACAS BASE "+nivel; }
setParameterByName_5 = Element.SetParameterByName(element=set_viewrange, parameterName=code_block_45, value=code_block_50)
viewlevel = Custom[© ViewLevel](views=setParameterByName_5)  # package Crumple; Returns the associated level of a view (if it has one), as well as a boolean mask to remove views without levels after.
byLevel_2 = StructuralPlanView.ByLevel(level=viewlevel.lvls)
code_block_51 = CodeBlock { "Zona"; }
code_block_52 = CodeBlock { null; }
replaceEmptyLists_6 = Custom[List.ReplaceEmptyLists](seq=setParameterByName_5, Replacement=code_block_52)
code_block_53 = CodeBlock(x=replaceEmptyLists_6)  # same code as code_block_27
code_block_54 = CodeBlock(x=code_block_53.out1) { DSCore.List.UniqueItems(x.GetParameterValueByName("Zona"))[0]; }
setParameterByName_6 = Element.SetParameterByName(element=byLevel_2, parameterName=code_block_51, value=code_block_54, lacing=Longest)
view_family_types_ᶜᵒⁿᵛᵉʳᵗᵉᵈ_3 = CodeBlock()  # "View Family Types ⁽ᶜᵒⁿᵛᵉʳᵗᵉᵈ ᵈʳᵒᵖᵈᵒʷⁿ⁾"
# ---------- view_family_types_ᶜᵒⁿᵛᵉʳᵗᵉᵈ_3.designscript (3 lines) ----------
//Structural Plan (Cielo);
Revit.Elements.ElementSelector.ByElementId(204495);
"Type";
# ----------------------------------------
setParameterByName_7 = Element.SetParameterByName(element=setParameterByName_6, parameterName=view_family_types_ᶜᵒⁿᵛᵉʳᵗᵉᵈ_3.out1, value=view_family_types_ᶜᵒⁿᵛᵉʳᵗᵉᵈ_3.out0, lacing=Longest)
scale = Custom[View.Scale](view=setParameterByName_5)  # package Clockwork for Dynamo 2.x; Returns the scale of a given view
code_block_55 = CodeBlock(l=scale)
# ---------- code_block_55.designscript (13 lines) ----------
l;

[Imperative]
{
	if (l == [])
		{
		return = [[]];
		}
	else
		{
		return = l[0];
		}
};
# ----------------------------------------
setScale_2 = View.SetScale(view=setParameterByName_7, scale=code_block_55.out1)
code_block_56 = CodeBlock { null; }
replaceEmptyLists_7 = Custom[List.ReplaceEmptyLists](seq=setParameterByName_7, Replacement=code_block_56)
all_2 = Orchid.RevitProject.Views.ViewTemplate.InDocument()  # "ViewTemplate.All"
flatten_2 = List.Flatten(list=all_2.ViewTemplate)
name_6 = Element.Name(element=flatten_2)
code_block_57 = CodeBlock { "Architectural Reflected Ceiling Plan"; }
eq_3 = name_6 == code_block_57
filterByBoolMask_3 = List.FilterByBoolMask(list=flatten_2, mask=eq_3)
code_block_58 = CodeBlock(x=replaceEmptyLists_7, y=filterByBoolMask_3.in)  # same code as code_block_22
code_block_59 = CodeBlock(x=replaceEmptyLists_7)  # same code as code_block_27
code_block_60 = CodeBlock(x=code_block_59.out1) { "05_EM_"+DSCore.List.UniqueItems(x.GetParameterValueByName("Zona"))[0]; }
code_block_61 = CodeBlock(esc=code_block_60) { "01_ENTREGABLE_05_EM_STRUCTURAL PLAN (CIELO)_"+esc; }
duplicate_2 = Orchid.RevitProject.Views.ViewTemplate.Duplicate(viewTemplate=code_block_58.out2, name=code_block_61)
code_block_62 = CodeBlock(esc=code_block_60)  # same code as code_block_24
setParameterByName_8 = Element.SetParameterByName(element=duplicate_2, parameterName=code_block_62.out0, value=code_block_62.out1, lacing=Longest)
uniqueItems_2 = List.UniqueItems(list=setParameterByName_8)
await_ = Orchid.Common.DataStream.Await(pass=code_block_60, waitFor=setScale_2)
byName_3 = Orchid.RevitProject.Filters.ParameterFilter.ByName(name=await_)
code_block_63 = CodeBlock { false; }
addFilter_2 = Orchid.RevitProject.Views.View.AddFilter(view=uniqueItems_2, parameterFilter=byName_3, visibility=code_block_63, lacing=Longest)
set_2 = Orchid.RevitProject.Views.ViewTemplate.Set(view=setScale_2, viewTemplate=addFilter_2, lacing=Longest)
element_level_2 = Custom[Element Level](element=set_2)
levelAbove = Custom[Level.LevelAbove](level=element_level_2)  # package archi-lab.net; This node takes an input of level and returns level above it.
empty = List.Empty()
replacenulls = Custom[© ReplaceNulls](lst=levelAbove, replace=empty)  # package Crumple; Replaces all nulls with a given substitute.
code_block_64 = CodeBlock { 1000; 300; }
set_viewrange_2 = Custom[Set ViewRange](view=set_2, TopLevel=replacenulls, Top=code_block_64.out1, CutLevel=element_level_2, CutPlane=code_block_64.out0, BottomLevel=element_level_2, Bottom=code_block_64.out0, DepthLevel=replacenulls, ViewDepth=code_block_64.out1, lacing=Longest)
code_block_65 = CodeBlock { "View Name"; }
identity_2 = Object.Identity(object=set_viewrange_2)
code_block_66 = CodeBlock()  # same code as code_block_33
getParameterValueByName_4 = Element.GetParameterValueByName(element=identity_2@L1, parameterName=code_block_66@L2, lacing=Longest)
code_block_67 = CodeBlock { null; }
replaceEmptyLists_8 = Custom[List.ReplaceEmptyLists](seq=getParameterValueByName_4, Replacement=code_block_67)
code_block_68 = CodeBlock(x=replaceEmptyLists_8, y=getParameterValueByName_4)  # same code as code_block_35
code_block_69 = CodeBlock { 1; }
getItemAtIndex_5 = List.GetItemAtIndex(list=code_block_68.out2@L2, index=code_block_69)
code_block_70 = CodeBlock { "_"; }
code_block_71 = CodeBlock { 0; }
getItemAtIndex_6 = List.GetItemAtIndex(list=code_block_68.out2@L2, index=code_block_71)
nullToEmptyList_4 = WombatDynamo.List.NullToEmptyList(data=getItemAtIndex_6)
name_7 = Element.Name(element=nullToEmptyList_4)
code_block_72 = CodeBlock { 0; 17; }
remove_3 = String.Remove(string=name_7, startIndex=code_block_72.out0, count=code_block_72.out1)
code_block_73 = CodeBlock { ")"; ""; }
replace_2 = String.Replace(string=remove_3, searchFor=code_block_73.out0, replaceWith=code_block_73.out1)
toUpper_2 = String.ToUpper(string=replace_2)
name_8 = Element.Name(element=identity_2)
code_block_74 = CodeBlock { "Zona"; }
getParameterValueByName_5 = Element.GetParameterValueByName(element=identity_2, parameterName=code_block_74)
list_create_4 = List.Create(item0=getItemAtIndex_5, item1=toUpper_2, item2=name_8, item3=getParameterValueByName_5)
transpose_2 = List.Transpose(lists=list_create_4)
join_2 = String.Join(separator=code_block_70, string0=transpose_2@L2)
code_block_75 = CodeBlock(x=getItemAtIndex_5, y=join_2)  # same code as code_block_42
code_block_76 = CodeBlock { 0; 3; }
remove_4 = String.Remove(string=code_block_75.out2, startIndex=code_block_76.out0, count=code_block_76.out1)
code_block_77 = CodeBlock { null; }
replaceEmptyLists_9 = Custom[List.ReplaceEmptyLists](seq=remove_4, Replacement=code_block_77)
code_block_78 = CodeBlock(l=replaceEmptyLists_9)
# ---------- code_block_78.designscript (13 lines) ----------
l;

[Imperative]
{
	if (l == null)
		{
		return = null;
		}
	else
		{
		return = l;
		}
};
# ----------------------------------------
setParameterByName_9 = Element.SetParameterByName(element=set_viewrange_2, parameterName=code_block_65, value=code_block_78.out1, lacing=Longest)
code_block_79 = CodeBlock()
# ---------- code_block_79.designscript (4 lines) ----------
[
"Subclasificacion",
"Zona"
];
# ----------------------------------------
getParameterValueByName_6 = Element.GetParameterValueByName(element=setParameterByName_9, parameterName=code_block_79)
uniqueItems_3 = List.UniqueItems(list=getParameterValueByName_6)
code_block_80 = CodeBlock { null; }
replaceEmptyLists_10 = Custom[List.ReplaceEmptyLists](seq=uniqueItems_3, Replacement=code_block_80)
code_block_81 = CodeBlock(x=replaceEmptyLists_10)
# ---------- code_block_81.designscript (13 lines) ----------
x;

[Imperative]
{
	if (x == null)
		{
		return = [[],[]];
		}
	else
		{
		return = x;
		}
};
# ----------------------------------------
all_3 = Orchid.RevitProject.Views.ViewTemplate.InDocument()  # "ViewTemplate.All"
flatten_3 = List.Flatten(list=all_3.ViewTemplate)
name_9 = Element.Name(element=flatten_3)
code_block_82 = CodeBlock { "Architectural Section"; }
eq_4 = name_9 == code_block_82
filterByBoolMask_4 = List.FilterByBoolMask(list=flatten_3, mask=eq_4)
code_block_83 = CodeBlock(x=code_block_81.out1, y=filterByBoolMask_4.in)
# ---------- code_block_83.designscript (15 lines) ----------
x[0];
x[1];
y;

[Imperative]
{
	if (x == null)
		{
		return = [];
		}
	else
		{
		return = y;
		}
};
# ----------------------------------------
code_block_84 = CodeBlock(esc=code_block_83.out1) { "01_ENTREGABLE_05_EM_BUILDING SECTION_"+esc; }
duplicate_3 = Orchid.RevitProject.Views.ViewTemplate.Duplicate(viewTemplate=code_block_83.out3, name=code_block_84)
code_block_85 = CodeBlock(x=code_block_81.out1)
# ---------- code_block_85.designscript (13 lines) ----------
x;

[Imperative]
{
	if (x == null)
		{
		return = [];
		}
	else
		{
		return = x;
		}
};
# ----------------------------------------
code_block_86 = CodeBlock(lst=code_block_85.out1)
# ---------- code_block_86.designscript (15 lines) ----------
lst;

[
"Clasificacion",
"Subclasificacion",
"Zona",
"Discipline"
];

[
"01_ENTREGABLE",
lst[0],
lst[1],
2
];
# ----------------------------------------
setParameterByName_10 = Element.SetParameterByName(element=duplicate_3, parameterName=code_block_86.out1, value=code_block_86.out2, lacing=Longest)
uniqueItems_4 = List.UniqueItems(list=setParameterByName_10)
code_block_87 = CodeBlock(esc=code_block_83.out1) { "05_EM_"+esc; }
await_2 = Orchid.Common.DataStream.Await(pass=code_block_87, waitFor=uniqueItems_4)
byName_4 = Orchid.RevitProject.Filters.ParameterFilter.ByName(name=await_2)
code_block_88 = CodeBlock { false; }
addFilter_3 = Orchid.RevitProject.Views.View.AddFilter(view=uniqueItems_4, parameterFilter=byName_4, visibility=code_block_88, lacing=Longest)
end = Revit.Transaction.Transaction.End(input=addFilter_3)
await_3 = Orchid.Common.DataStream.Await(pass=code_block_83.out1, waitFor=end)
code_block_89 = CodeBlock(esc=await_3) { "Building Section (05_EM_"+esc+")"; }
duplicate_4 = archilab.Revit.Elements.ElementTypes.Duplicate(element=view_family_types_ᶜᵒⁿᵛᵉʳᵗᵉᵈ, name=code_block_89)
code_block_90 = CodeBlock { "View Template applied to new views"; }
setParameterByName_11 = Element.SetParameterByName(element=duplicate_4, parameterName=code_block_90, value=end)
view_family_types_ᶜᵒⁿᵛᵉʳᵗᵉᵈ_4 = CodeBlock()  # "View Family Types ⁽ᶜᵒⁿᵛᵉʳᵗᵉᵈ ᵈʳᵒᵖᵈᵒʷⁿ⁾"
# ---------- view_family_types_ᶜᵒⁿᵛᵉʳᵗᵉᵈ_4.designscript (2 lines) ----------
//Detail;
Revit.Elements.ElementSelector.ByElementId(69335);
# ----------------------------------------
all_4 = Orchid.RevitProject.Views.ViewTemplate.InDocument()  # "ViewTemplate.All"
flatten_4 = List.Flatten(list=all_4.ViewTemplate)
name_10 = Element.Name(element=flatten_4)
code_block_91 = CodeBlock { "Architectural Detail"; }
eq_5 = name_10 == code_block_91
filterByBoolMask_5 = List.FilterByBoolMask(list=flatten_4, mask=eq_5)
code_block_92 = CodeBlock(x=code_block_81.out1, y=filterByBoolMask_5.in)  # same code as code_block_83
code_block_93 = CodeBlock(esc=code_block_92.out1) { "01_ENTREGABLE_05_EM_DETAIL_"+esc; }
duplicate_5 = Orchid.RevitProject.Views.ViewTemplate.Duplicate(viewTemplate=code_block_92.out3, name=code_block_93)
code_block_94 = CodeBlock(x=code_block_81.out1)  # same code as code_block_85
code_block_95 = CodeBlock(lst=code_block_94.out1)  # same code as code_block_86
setParameterByName_12 = Element.SetParameterByName(element=duplicate_5, parameterName=code_block_95.out1, value=code_block_95.out2, lacing=Longest)
uniqueItems_5 = List.UniqueItems(list=setParameterByName_12)
code_block_96 = CodeBlock(esc=code_block_92.out1) { "05_EM_"+esc; }
await_4 = Orchid.Common.DataStream.Await(pass=code_block_96, waitFor=uniqueItems_5)
byName_5 = Orchid.RevitProject.Filters.ParameterFilter.ByName(name=await_4)
code_block_97 = CodeBlock { false; }
addFilter_4 = Orchid.RevitProject.Views.View.AddFilter(view=uniqueItems_5, parameterFilter=byName_5, visibility=code_block_97, lacing=Longest)
end_2 = Revit.Transaction.Transaction.End(input=addFilter_4)
await_5 = Orchid.Common.DataStream.Await(pass=code_block_92.out1, waitFor=end_2)
code_block_98 = CodeBlock(esc=await_5) { "Detail (05_EM_"+esc+")"; }
duplicate_6 = archilab.Revit.Elements.ElementTypes.Duplicate(element=view_family_types_ᶜᵒⁿᵛᵉʳᵗᵉᵈ_4, name=code_block_98)
code_block_99 = CodeBlock { "View Template applied to new views"; }
setParameterByName_13 = Element.SetParameterByName(element=duplicate_6, parameterName=code_block_99, value=end_2)
