# Dynamo graph PlantasES_script.dyn (Dynamo 2.16.1.2727)
# packages: Data-Shapes 2022.2.96, WombatDynamo 2.3.4, Orchid 200.4.0.7938, Data-Shapes 2021.2.94, Clockwork for Dynamo 2.x 2.4.0, Genius Loci 2020.8.3, archi-lab.net 2022.210.2419

code_block = CodeBlock { "Plantas Escalera - ES"; }
code_block_2 = CodeBlock { "OK"; 450; }
code_block_3 = CodeBlock { "Error"; }
code_block_4 = CodeBlock { "Las vistas de esta Escalera ya fueron generadas. Para vistas adicionales, duplicar de las ya existentes."; }
textnote_data = Custom[TextNote Data](Title=code_block_3, TextNote=code_block_4)  # package Data-Shapes; Create Data for TextNote input in UI.MultipleInputForm ++ . Check out www.data-shapes.net for more informations
all = Orchid.RevitProject.Views.View.InDocument()  # "View.All"
code_block_5 = CodeBlock { "Subclasificacion"; }
getParameterValueByName = Element.GetParameterValueByName(element=all, parameterName=code_block_5)
code_block_6 = CodeBlock { "06_ES"; }
eq = getParameterValueByName == code_block_6
filterByBoolMask = List.FilterByBoolMask(list=all, mask=eq)
code_block_7 = CodeBlock { "Plantas Escalera - ES"; }
code_block_8 = CodeBlock()
# ---------- code_block_8.designscript (6 lines) ----------
"INICIAR";
"CANCELAR";
//Label
120;
//Width
450;
# ----------------------------------------
code_block_9 = CodeBlock { "Niveles:"; }
code_block_10 = CodeBlock { "Levels"; }
byName = Category.ByName(name=code_block_10)
all_elements_of_category = ElementsOfCategory(Category=byName)
elevation = Level.Elevation(level=all_elements_of_category)
sortByKey = List.SortByKey(list=all_elements_of_category, keys=elevation)
code_block_11 = CodeBlock { "Building Story"; }
getParameterValueByName_2 = Element.GetParameterValueByName(element=sortByKey.sortedList, parameterName=code_block_11)
code_block_12 = CodeBlock { 1; }
eq_2 = getParameterValueByName_2 == code_block_12
filterByBoolMask_2 = List.FilterByBoolMask(list=sortByKey.sortedList, mask=eq_2)
name = Element.Name(element=filterByBoolMask_2.in)
code_block_13 = CodeBlock()
# ---------- code_block_13.designscript (8 lines) ----------
//Height
360;
//elemCount
true;
//sort
false;
//id
false;
# ----------------------------------------
code_block_14 = CodeBlock(l=name) { count = DSCore.List.Count(l) - 1; 0..count..1; }
listview_data = Custom[Listview Data](InputName=code_block_9, Keys=name, Values=filterByBoolMask_2.in, Height_optionnal=code_block_13.out0, ShowElementCount_optionnal=code_block_13.out1, DefaultValueIndices_optionnal=code_block_14.out1, SortItems_optionnal=code_block_13.out2, ShowId_optionnal=code_block_13.out3)  # package Data-Shapes; Create data for ListView input in UI.MultiInputForm ++ . Check out www.data-shapes.net for more infos.
code_block_15 = CodeBlock { "Escala:"; }
code_block_16 = CodeBlock()
# ---------- code_block_16.designscript (10 lines) ----------
[
"1:50",
"1:75",
"1:100",
"1:125",
"1:150",
"1:175",
"1:200"
];
":";
# ----------------------------------------
split = String.Split(string=code_block_16.out0, separator0=code_block_16.out1)
code_block_17 = CodeBlock { 1; }
getItemAtIndex = List.GetItemAtIndex(list=split@L2, index=code_block_17)
toNumber = String.ToNumber(string=getItemAtIndex)
code_block_18 = CodeBlock { 0; false; }
dropdown_data = Custom[DropDown Data](InputName=code_block_15, Keys=code_block_16.out0, Values=toNumber, DefaultValueIndex=code_block_18.out0, Sorted_optional=code_block_18.out1)  # package Data-Shapes; Create data for DropDown input in UI.MultiInputForm ++ . Check out www.data-shapes.net for more infos.
code_block_19 = CodeBlock { "Nombre Escalera:"; "Ejemplo, ESC-01"; }
textbox_data = Custom[TextBox Data](InputName=code_block_19.out0, DefaultText=code_block_19.out1)  # package Data-Shapes; Create Data for TextBox input in UI.MultipleInputForm ++ . Check out www.data-shapes.net for more informations
code_block_20 = CodeBlock()
# ---------- code_block_20.designscript (2 lines) ----------
"Importante:";
"El nombre o numeración de la Escalera debe ser único. Si ya existe, por ejemplo, la escalera ESC-01, usar un nombre o numeración diferente.";
# ----------------------------------------
textnote_data_2 = Custom[TextNote Data](Title=code_block_20.out0, TextNote=code_block_20.out1)
list_create = List.Create(item0=textbox_data, item1=textnote_data_2)
inputgroup_data = Custom[InputGroup Data](Inputs=list_create)  # package Data-Shapes; Creates a group of inputs for UI.MultipleInputForm ++ . Check out www.data-shapes.net for more infos !
list_create_2 = List.Create(item0=listview_data, item1=dropdown_data, item2=inputgroup_data)
boolean = BoolSelector(true)
multipleinputform = Custom[MultipleInputForm ++](Description_optional=code_block_7, ButtonText_optional=code_block_8.out0, Inputs=list_create_2, Toggle=boolean, CancelButtonText_optional=code_block_8.out1, Width_optional=code_block_8.out3, LabelWidth_optional=code_block_8.out2)  # package Data-Shapes; Create a form with multiple inputs. see www.data-shapes.net for tutorials and infos!
code_block_21 = CodeBlock(l=multipleinputform.User_Inputs)
# ---------- code_block_21.designscript (12 lines) ----------
l;
[Imperative]
{
	if (l == null)
		{
		return = [[],[],[]];
		}
	else
		{
		return = l;
		}
};
# ----------------------------------------
code_block_22 = CodeBlock(l=code_block_21.out1) { DSCore.String.ToUpper(DSCore.List.Flatten(([l[2]]),1)); }
code_block_23 = CodeBlock { "Zona"; }
getParameterValueByName_3 = Element.GetParameterValueByName(element=filterByBoolMask.in, parameterName=code_block_23)
uniqueItems = List.UniqueItems(list=getParameterValueByName_3)
eq_3 = code_block_22 == uniqueItems
filterByBoolMask_3 = List.FilterByBoolMask(list=filterByBoolMask.in, mask=eq_3)
code_block_24 = CodeBlock { null; }
replaceEmptyLists = Custom[List.ReplaceEmptyLists](seq=filterByBoolMask_3.in, Replacement=code_block_24)  # package Clockwork for Dynamo 2.x; Replaces all empty lists within a given list with a substitute
isNull = Object.IsNull(object=replaceEmptyLists)
code_block_25 = CodeBlock { true; false; }
scopeIf = Custom[ScopeIf+](test=isNull, True=code_block_25.out1, False=code_block_25.out0)  # package Clockwork for Dynamo 2.x; A (hopefully) more robust implementation of ScopeIf. Tests a single boolean and returns a value accordingly.
multipleinputform_2 = Custom[MultipleInputForm ++](Description_optional=code_block, ButtonText_optional=code_block_2.out0, Inputs=textnote_data, Toggle=scopeIf, Width_optional=code_block_2.out1)
view_family_types_ᶜᵒⁿᵛᵉʳᵗᵉᵈ = CodeBlock()  # "View Family Types ⁽ᶜᵒⁿᵛᵉʳᵗᵉᵈ ᵈʳᵒᵖᵈᵒʷⁿ⁾"
# ---------- view_family_types_ᶜᵒⁿᵛᵉʳᵗᵉᵈ.designscript (2 lines) ----------
//Building Section;
Revit.Elements.ElementSelector.ByElementId(69334);
# ----------------------------------------
code_block_26 = CodeBlock(l=replaceEmptyLists, lst=code_block_21.out1)
# ---------- code_block_26.designscript (14 lines) ----------
l;
lst;

[Imperative]
{
	if (l == null)
		{
		return = lst;
		}
	else
		{
		return = [[],[],[]];
		}
};
# ----------------------------------------
code_block_27 = CodeBlock(l=code_block_26.out2) { DSCore.List.Flatten(([l[0]]),1); }
nullToEmptyList = WombatDynamo.List.NullToEmptyList(data=code_block_27)
byLevel = StructuralPlanView.ByLevel(level=nullToEmptyList)
code_block_28 = CodeBlock { "Zona"; }
code_block_29 = CodeBlock(l=code_block_26.out2) { DSCore.String.ToUpper(DSCore.List.Flatten(([l[2]]),1)); }
setParameterByName = Element.SetParameterByName(element=byLevel, parameterName=code_block_28, value=code_block_29, lacing=Longest)
view_family_types_ᶜᵒⁿᵛᵉʳᵗᵉᵈ_2 = CodeBlock()  # "View Family Types ⁽ᶜᵒⁿᵛᵉʳᵗᵉᵈ ᵈʳᵒᵖᵈᵒʷⁿ⁾"
# ---------- view_family_types_ᶜᵒⁿᵛᵉʳᵗᵉᵈ_2.designscript (3 lines) ----------
//Structural Plan (Piso);
Revit.Elements.ElementSelector.ByElementId(92026);
"Type";
# ----------------------------------------
setParameterByName_2 = Element.SetParameterByName(element=setParameterByName, parameterName=view_family_types_ᶜᵒⁿᵛᵉʳᵗᵉᵈ_2.out1, value=view_family_types_ᶜᵒⁿᵛᵉʳᵗᵉᵈ_2.out0)
code_block_30 = CodeBlock(l=code_block_26.out2) { DSCore.List.Flatten(([l[1]]),1); }
nullToEmptyList_2 = WombatDynamo.List.NullToEmptyList(data=code_block_30)
setScale = View.SetScale(view=setParameterByName_2, scale=nullToEmptyList_2, lacing=Longest)
code_block_31 = CodeBlock { null; }
replaceEmptyLists_2 = Custom[List.ReplaceEmptyLists](seq=setScale, Replacement=code_block_31)
all_2 = Orchid.RevitProject.Views.ViewTemplate.InDocument()  # "ViewTemplate.All"
flatten = List.Flatten(list=all_2.ViewTemplate)
name_2 = Element.Name(element=flatten)
code_block_32 = CodeBlock { "Structural Foundation Plan"; }
eq_4 = name_2 == code_block_32
filterByBoolMask_4 = List.FilterByBoolMask(list=flatten, mask=eq_4)
code_block_33 = CodeBlock(x=replaceEmptyLists_2, y=filterByBoolMask_4.in)
# ---------- code_block_33.designscript (14 lines) ----------
x;
y;

[Imperative]
{
	if (x == null)
		{
		return = [];
		}
	else
		{
		return = y;
		}
};
# ----------------------------------------
code_block_34 = CodeBlock(x=setScale) { esc = DSCore.List.UniqueItems(x.GetParameterValueByName("Zona")); "01_ENTREGABLE_06_ES_STRUCTURAL PLAN (PISO)_"+esc; }
duplicate = Orchid.RevitProject.Views.ViewTemplate.Duplicate(viewTemplate=code_block_33.out2, name=code_block_34.out1)
code_block_35 = CodeBlock(esc=code_block_34.esc)
# ---------- code_block_35.designscript (13 lines) ----------
DSCore.List.Flatten(
[
"Clasificacion",
"Subclasificacion",
"Zona"
]);

DSCore.List.Flatten(
[
"01_ENTREGABLE",
"06_ES",
esc
]);
# ----------------------------------------
setParameterByName_3 = Element.SetParameterByName(element=duplicate, parameterName=code_block_35.out0, value=code_block_35.out1, lacing=Longest)
uniqueItems_2 = List.UniqueItems(list=setParameterByName_3)
code_block_36 = CodeBlock { null; }
replaceEmptyLists_3 = Custom[List.ReplaceEmptyLists](seq=uniqueItems_2, Replacement=code_block_36)
code_block_37 = CodeBlock { null; }
replaceEmptyLists_4 = Custom[List.ReplaceEmptyLists](seq=setParameterByName_3, Replacement=code_block_37)
code_block_38 = CodeBlock(x=replaceEmptyLists_4)
# ---------- code_block_38.designscript (13 lines) ----------
x;

[Imperative]
{
	if (x == null)
		{
		return = [[]];
		}
	else
		{
		return = x;
		}
};
# ----------------------------------------
code_block_39 = CodeBlock(a=code_block_38.out1)
# ---------- code_block_39.designscript (6 lines) ----------
esc = DSCore.List.UniqueItems(a.GetParameterValueByName("Zona"))[0];

["Zona","Subclasificacion"];
["NotEquals","NotEquals"];
[esc,"05_EM"];
"06_ES_"+esc;
# ----------------------------------------
code_block_40 = CodeBlock(x=replaceEmptyLists_3, y=code_block_39.out4)  # same code as code_block_33
create = Orchid.RevitProject.Filters.FilterRule.Create(parameter=code_block_39.out1, ruleType=code_block_39.out2, value=code_block_39.out3)
code_block_41 = CodeBlock { "Sections"; }
byName_2 = Category.ByName(name=code_block_41)
byRule = Orchid.RevitProject.Filters.ParameterFilter.Create(name=code_block_40.out2@L1, filterRule=create@L2, category=byName_2@L1, lacing=Longest)  # "ParameterFilter.ByRule"
code_block_42 = CodeBlock { false; }
addFilter = Orchid.RevitProject.Views.View.AddFilter(view=uniqueItems_2, parameterFilter=byRule, visibility=code_block_42, lacing=Longest)
set = Orchid.RevitProject.Views.ViewTemplate.Set(view=setScale, viewTemplate=addFilter, lacing=Longest)
code_block_43 = CodeBlock { "View Name"; }
identity = Object.Identity(object=set)
code_block_44 = CodeBlock()
# ---------- code_block_44.designscript (4 lines) ----------
[
"Type",
"Subclasificacion"
];
# ----------------------------------------
getParameterValueByName_4 = Element.GetParameterValueByName(element=identity@L1, parameterName=code_block_44@L2, lacing=Longest)
code_block_45 = CodeBlock { null; }
replaceEmptyLists_5 = Custom[List.ReplaceEmptyLists](seq=getParameterValueByName_4, Replacement=code_block_45)
code_block_46 = CodeBlock(x=replaceEmptyLists_5, y=getParameterValueByName_4)
# ---------- code_block_46.designscript (14 lines) ----------
x;
y;

[Imperative]
{
	if (x == null)
		{
		return = [null,null];
		}
	else
		{
		return = y;
		}
};
# ----------------------------------------
code_block_47 = CodeBlock { 1; }
getItemAtIndex_2 = List.GetItemAtIndex(list=code_block_46.out2@L2, index=code_block_47)
code_block_48 = CodeBlock { "_"; }
code_block_49 = CodeBlock { 0; }
getItemAtIndex_3 = List.GetItemAtIndex(list=code_block_46.out2@L2, index=code_block_49)
nullToEmptyList_3 = WombatDynamo.List.NullToEmptyList(data=getItemAtIndex_3)
name_3 = Element.Name(element=nullToEmptyList_3)
code_block_50 = CodeBlock { 0; 17; }
remove = String.Remove(string=name_3, startIndex=code_block_50.out0, count=code_block_50.out1)
code_block_51 = CodeBlock { ")"; ""; }
replace = String.Replace(string=remove, searchFor=code_block_51.out0, replaceWith=code_block_51.out1)
toUpper = String.ToUpper(string=replace)
name_4 = Element.Name(element=identity)
code_block_52 = CodeBlock { "Zona"; }
getParameterValueByName_5 = Element.GetParameterValueByName(element=identity, parameterName=code_block_52)
list_create_3 = List.Create(item0=getItemAtIndex_2, item1=toUpper, item2=name_4, item3=getParameterValueByName_5)
transpose = List.Transpose(lists=list_create_3)
join = String.Join(separator=code_block_48, string0=transpose@L2)
code_block_53 = CodeBlock(x=getItemAtIndex_2, y=join)
# ---------- code_block_53.designscript (14 lines) ----------
x;
y;

[Imperative]
{
	if (x[0] == null)
		{
		return = [];
		}
	else
		{
		return = y;
		}
};
# ----------------------------------------
code_block_54 = CodeBlock { 0; 3; }
remove_2 = String.Remove(string=code_block_53.out2, startIndex=code_block_54.out0, count=code_block_54.out1)
setParameterByName_4 = Element.SetParameterByName(element=set, parameterName=code_block_43, value=remove_2)
element_level = Custom[Element Level](element=setParameterByName_4)  # package Genius Loci; Gets an element's level. Based on a Clockwork's node
code_block_55 = CodeBlock { 750; -1500; }
set_viewrange = Custom[Set ViewRange](view=setParameterByName_4, TopLevel=element_level, Top=code_block_55.out0, CutLevel=element_level, CutPlane=code_block_55.out0, BottomLevel=element_level, Bottom=code_block_55.out1, DepthLevel=element_level, ViewDepth=code_block_55.out1, lacing=Longest)  # package Genius Loci; Set the view range of the given plan view.
code_block_56 = CodeBlock { "Title on Sheet"; }
name_5 = Element.Name(element=set_viewrange)
code_block_57 = CodeBlock { "_"; }
split_2 = String.Split(string=name_5, separator0=code_block_57)
code_block_58 = CodeBlock { null; }
replaceEmptyLists_6 = Custom[List.ReplaceEmptyLists](seq=split_2, Replacement=code_block_58)
code_block_59 = CodeBlock(x=replaceEmptyLists_6, y=split_2)
# ---------- code_block_59.designscript (14 lines) ----------
x;
y;

[Imperative]
{
	if (x == null)
		{
		return = [null,null,null,null];
		}
	else
		{
		return = y;
		}
};
# ----------------------------------------
code_block_60 = CodeBlock { 2; }
getItemAtIndex_4 = List.GetItemAtIndex(list=code_block_59.out2@L2, index=code_block_60)
code_block_61 = CodeBlock(nivel=getItemAtIndex_4) { title = "PLANTA ESCALERA "+nivel; }
setParameterByName_5 = Element.SetParameterByName(element=set_viewrange, parameterName=code_block_56, value=code_block_61)
code_block_62 = CodeBlock()
# ---------- code_block_62.designscript (4 lines) ----------
[
"Subclasificacion",
"Zona"
];
# ----------------------------------------
getParameterValueByName_6 = Element.GetParameterValueByName(element=setParameterByName_5, parameterName=code_block_62)
uniqueItems_3 = List.UniqueItems(list=getParameterValueByName_6)
code_block_63 = CodeBlock { null; }
replaceEmptyLists_7 = Custom[List.ReplaceEmptyLists](seq=uniqueItems_3, Replacement=code_block_63)
code_block_64 = CodeBlock(x=replaceEmptyLists_7)
# ---------- code_block_64.designscript (13 lines) ----------
x;

[Imperative]
{
	if (x == null)
		{
		return = [[],[]];
		}
	else
		{
		return = x;
		}
};
# ----------------------------------------
all_3 = Orchid.RevitProject.Views.ViewTemplate.InDocument()  # "ViewTemplate.All"
flatten_2 = List.Flatten(list=all_3.ViewTemplate)
name_6 = Element.Name(element=flatten_2)
code_block_65 = CodeBlock { "Architectural Section"; }
eq_5 = name_6 == code_block_65
filterByBoolMask_5 = List.FilterByBoolMask(list=flatten_2, mask=eq_5)
code_block_66 = CodeBlock(x=code_block_64.out1, y=filterByBoolMask_5.in)
# ---------- code_block_66.designscript (15 lines) ----------
x[0];
x[1];
y;

[Imperative]
{
	if (x == null)
		{
		return = [];
		}
	else
		{
		return = y;
		}
};
# ----------------------------------------
code_block_67 = CodeBlock(esc=code_block_66.out1) { "01_ENTREGABLE_06_ES_BUILDING SECTION_"+esc; }
duplicate_2 = Orchid.RevitProject.Views.ViewTemplate.Duplicate(viewTemplate=code_block_66.out3, name=code_block_67)
code_block_68 = CodeBlock(x=code_block_64.out1)
# ---------- code_block_68.designscript (13 lines) ----------
x;

[Imperative]
{
	if (x == null)
		{
		return = [];
		}
	else
		{
		return = x;
		}
};
# ----------------------------------------
code_block_69 = CodeBlock(lst=code_block_68.out1)
# ---------- code_block_69.designscript (15 lines) ----------
lst;

[
"Clasificacion",
"Subclasificacion",
"Zona",
"Discipline"
];

[
"01_ENTREGABLE",
lst[0],
lst[1],
2
];
# ----------------------------------------
setParameterByName_6 = Element.SetParameterByName(element=duplicate_2, parameterName=code_block_69.out1, value=code_block_69.out2, lacing=Longest)
uniqueItems_4 = List.UniqueItems(list=setParameterByName_6)
code_block_70 = CodeBlock(esc=code_block_66.out1) { "06_ES_"+esc; }
await_ = Orchid.Common.DataStream.Await(pass=code_block_70, waitFor=uniqueItems_4)
byName_3 = Orchid.RevitProject.Filters.ParameterFilter.ByName(name=await_)
code_block_71 = CodeBlock { false; }
addFilter_2 = Orchid.RevitProject.Views.View.AddFilter(view=uniqueItems_4, parameterFilter=byName_3, visibility=code_block_71, lacing=Longest)
end = Revit.Transaction.Transaction.End(input=addFilter_2)
await_2 = Orchid.Common.DataStream.Await(pass=code_block_66.out1, waitFor=end)
code_block_72 = CodeBlock(esc=await_2) { "Building Section (06_ES_"+esc+")"; }
duplicate_3 = archilab.Revit.Elements.ElementTypes.Duplicate(element=view_family_types_ᶜᵒⁿᵛᵉʳᵗᵉᵈ, name=code_block_72)
code_block_73 = CodeBlock { "View Template applied to new views"; }
setParameterByName_7 = Element.SetParameterByName(element=duplicate_3, parameterName=code_block_73, value=end)
view_family_types_ᶜᵒⁿᵛᵉʳᵗᵉᵈ_3 = CodeBlock()  # "View Family Types ⁽ᶜᵒⁿᵛᵉʳᵗᵉᵈ ᵈʳᵒᵖᵈᵒʷⁿ⁾"
# ---------- view_family_types_ᶜᵒⁿᵛᵉʳᵗᵉᵈ_3.designscript (2 lines) ----------
//Detail;
Revit.Elements.ElementSelector.ByElementId(69335);
# ----------------------------------------
all_4 = Orchid.RevitProject.Views.ViewTemplate.InDocument()  # "ViewTemplate.All"
flatten_3 = List.Flatten(list=all_4.ViewTemplate)
name_7 = Element.Name(element=flatten_3)
code_block_74 = CodeBlock { "Architectural Detail"; }
eq_6 = name_7 == code_block_74
filterByBoolMask_6 = List.FilterByBoolMask(list=flatten_3, mask=eq_6)
code_block_75 = CodeBlock(x=code_block_64.out1, y=filterByBoolMask_6.in)  # same code as code_block_66
code_block_76 = CodeBlock(esc=code_block_75.out1) { "01_ENTREGABLE_06_ES_DETAIL_"+esc; }
duplicate_4 = Orchid.RevitProject.Views.ViewTemplate.Duplicate(viewTemplate=code_block_75.out3, name=code_block_76)
code_block_77 = CodeBlock(x=code_block_64.out1)  # same code as code_block_68
code_block_78 = CodeBlock(lst=code_block_77.out1)  # same code as code_block_69
setParameterByName_8 = Element.SetParameterByName(element=duplicate_4, parameterName=code_block_78.out1, value=code_block_78.out2, lacing=Longest)
uniqueItems_5 = List.UniqueItems(list=setParameterByName_8)
code_block_79 = CodeBlock(esc=code_block_75.out1) { "06_ES_"+esc; }
await_3 = Orchid.Common.DataStream.Await(pass=code_block_79, waitFor=uniqueItems_5)
byName_4 = Orchid.RevitProject.Filters.ParameterFilter.ByName(name=await_3)
code_block_80 = CodeBlock { false; }
addFilter_3 = Orchid.RevitProject.Views.View.AddFilter(view=uniqueItems_5, parameterFilter=byName_4, visibility=code_block_80, lacing=Longest)
end_2 = Revit.Transaction.Transaction.End(input=addFilter_3)
await_4 = Orchid.Common.DataStream.Await(pass=code_block_75.out1, waitFor=end_2)
code_block_81 = CodeBlock(esc=await_4) { "Detail (06_ES_"+esc+")"; }
duplicate_5 = archilab.Revit.Elements.ElementTypes.Duplicate(element=view_family_types_ᶜᵒⁿᵛᵉʳᵗᵉᵈ_3, name=code_block_81)
code_block_82 = CodeBlock { "View Template applied to new views"; }
setParameterByName_9 = Element.SetParameterByName(element=duplicate_5, parameterName=code_block_82, value=end_2)
