# Dynamo graph PlantasLO_script.dyn (Dynamo 2.16.1.2727)
# packages: Data-Shapes 2022.2.96, WombatDynamo 2.3.4, Orchid 200.4.0.7938, Data-Shapes 2021.2.94, Clockwork for Dynamo 2.x 2.4.0, Genius Loci 2020.8.3, archi-lab.net 2022.210.2419, Crumple 2022.2.13, Genius Loci 2021.11.10

code_block = CodeBlock { "Plantas Losas - LO"; }
code_block_2 = CodeBlock { "OK"; 450; }
code_block_3 = CodeBlock { "Error"; }
code_block_4 = CodeBlock { "Las vistas de este Estanque ya fueron generadas. Para vistas adicionales, duplicar de las ya existentes."; }
textnote_data = Custom[TextNote Data](Title=code_block_3, TextNote=code_block_4)  # package Data-Shapes; Create Data for TextNote input in UI.MultipleInputForm ++ . Check out www.data-shapes.net for more informations
all = Orchid.RevitProject.Views.View.InDocument()  # "View.All"
code_block_5 = CodeBlock { "Subclasificacion"; }
getParameterValueByName = Element.GetParameterValueByName(element=all, parameterName=code_block_5)
code_block_6 = CodeBlock { "07_DE"; }
eq = getParameterValueByName == code_block_6
filterByBoolMask = List.FilterByBoolMask(list=all, mask=eq)
code_block_7 = CodeBlock { "Plantas Losas - LO"; }
code_block_8 = CodeBlock()
# ---------- code_block_8.designscript (6 lines) ----------
"INICIAR";
"CANCELAR";
//Label
120;
//Width
450;
# ----------------------------------------
code_block_9 = CodeBlock { "Niveles:"; }
code_block_10 = CodeBlock { "Levels"; }
byName = Category.ByName(name=code_block_10)
all_elements_of_category = ElementsOfCategory(Category=byName)
elevation = Level.Elevation(level=all_elements_of_category)
sortByKey = List.SortByKey(list=all_elements_of_category, keys=elevation)
code_block_11 = CodeBlock { "Building Story"; }
getParameterValueByName_2 = Element.GetParameterValueByName(element=sortByKey.sortedList, parameterName=code_block_11)
code_block_12 = CodeBlock { 1; }
eq_2 = getParameterValueByName_2 == code_block_12
filterByBoolMask_2 = List.FilterByBoolMask(list=sortByKey.sortedList, mask=eq_2)
name = Element.Name(element=filterByBoolMask_2.in)
code_block_13 = CodeBlock()
# ---------- code_block_13.designscript (8 lines) ----------
//Height
360;
//elemCount
true;
//sort
false;
//id
false;
# ----------------------------------------
code_block_14 = CodeBlock(l=name) { count = DSCore.List.Count(l) - 1; 0..count..1; }
listview_data = Custom[Listview Data](InputName=code_block_9, Keys=name, Values=filterByBoolMask_2.in, Height_optionnal=code_block_13.out0, ShowElementCount_optionnal=code_block_13.out1, DefaultValueIndices_optionnal=code_block_14.out1, SortItems_optionnal=code_block_13.out2, ShowId_optionnal=code_block_13.out3)  # package Data-Shapes; Create data for ListView input in UI.MultiInputForm ++ . Check out www.data-shapes.net for more infos.
code_block_15 = CodeBlock { "Escala:"; }
code_block_16 = CodeBlock()
# ---------- code_block_16.designscript (10 lines) ----------
[
"1:50",
"1:75",
"1:100",
"1:125",
"1:150",
"1:175",
"1:200"
];
":";
# ----------------------------------------
split = String.Split(string=code_block_16.out0, separator0=code_block_16.out1)
code_block_17 = CodeBlock { 1; }
getItemAtIndex = List.GetItemAtIndex(list=split@L2, index=code_block_17)
toNumber = String.ToNumber(string=getItemAtIndex)
code_block_18 = CodeBlock { 0; false; }
dropdown_data = Custom[DropDown Data](InputName=code_block_15, Keys=code_block_16.out0, Values=toNumber, DefaultValueIndex=code_block_18.out0, Sorted_optional=code_block_18.out1)  # package Data-Shapes; Create data for DropDown input in UI.MultiInputForm ++ . Check out www.data-shapes.net for more infos.
code_block_19 = CodeBlock { "Nombre Estanque:"; "GENERAL"; }
textbox_data = Custom[TextBox Data](InputName=code_block_19.out0, DefaultText=code_block_19.out1)  # package Data-Shapes; Create Data for TextBox input in UI.MultipleInputForm ++ . Check out www.data-shapes.net for more informations
code_block_20 = CodeBlock()
# ---------- code_block_20.designscript (2 lines) ----------
"Importante:";
"Si el proyecto no esta dividido en Zonas, usar el valor por defecto General, de lo contrario, asignar una Zona.";
# ----------------------------------------
textnote_data_2 = Custom[TextNote Data](Title=code_block_20.out0, TextNote=code_block_20.out1)
list_create = List.Create(item0=textbox_data, item1=textnote_data_2)
inputgroup_data = Custom[InputGroup Data](Inputs=list_create)  # package Data-Shapes; Creates a group of inputs for UI.MultipleInputForm ++ . Check out www.data-shapes.net for more infos !
list_create_2 = List.Create(item0=listview_data, item1=dropdown_data, item2=inputgroup_data)
boolean = BoolSelector(true)
multipleinputform = Custom[MultipleInputForm ++](Description_optional=code_block_7, ButtonText_optional=code_block_8.out0, Inputs=list_create_2, Toggle=boolean, CancelButtonText_optional=code_block_8.out1, Width_optional=code_block_8.out3, LabelWidth_optional=code_block_8.out2)  # package Data-Shapes; Create a form with multiple inputs. see www.data-shapes.net for tutorials and infos!
code_block_21 = CodeBlock(l=multipleinputform.User_Inputs)
# ---------- code_block_21.designscript (12 lines) ----------
l;
[Imperative]
{
	if (l == null)
		{
		return = [[],[],[]];
		}
	else
		{
		return = l;
		}
};
# ----------------------------------------
code_block_22 = CodeBlock(l=code_block_21.out1) { DSCore.String.ToUpper(DSCore.List.Flatten(([l[2]]),1)); }
code_block_23 = CodeBlock { "Zona"; }
getParameterValueByName_3 = Element.GetParameterValueByName(element=filterByBoolMask.in, parameterName=code_block_23)
uniqueItems = List.UniqueItems(list=getParameterValueByName_3)
eq_3 = code_block_22 == uniqueItems
filterByBoolMask_3 = List.FilterByBoolMask(list=filterByBoolMask.in, mask=eq_3)
code_block_24 = CodeBlock { null; }
replaceEmptyLists = Custom[List.ReplaceEmptyLists](seq=filterByBoolMask_3.in, Replacement=code_block_24)  # package Clockwork for Dynamo 2.x; Replaces all empty lists within a given list with a substitute
isNull = Object.IsNull(object=replaceEmptyLists)
code_block_25 = CodeBlock { true; false; }
scopeIf = Custom[ScopeIf+](test=isNull, True=code_block_25.out1, False=code_block_25.out0)  # package Clockwork for Dynamo 2.x; A (hopefully) more robust implementation of ScopeIf. Tests a single boolean and returns a value accordingly.
multipleinputform_2 = Custom[MultipleInputForm ++](Description_optional=code_block, ButtonText_optional=code_block_2.out0, Inputs=textnote_data, Toggle=scopeIf, Width_optional=code_block_2.out1)
view_family_types_ᶜᵒⁿᵛᵉʳᵗᵉᵈ = CodeBlock()  # "View Family Types ⁽ᶜᵒⁿᵛᵉʳᵗᵉᵈ ᵈʳᵒᵖᵈᵒʷⁿ⁾"
# ---------- view_family_types_ᶜᵒⁿᵛᵉʳᵗᵉᵈ.designscript (2 lines) ----------
//Building Section;
Revit.Elements.ElementSelector.ByElementId(69334);
# ----------------------------------------
code_block_26 = CodeBlock(l=replaceEmptyLists, lst=code_block_21.out1)
# ---------- code_block_26.designscript (14 lines) ----------
l;
lst;

[Imperative]
{
	if (l == null)
		{
		return = lst;
		}
	else
		{
		return = [[],[],[]];
		}
};
# ----------------------------------------
code_block_27 = CodeBlock(l=code_block_26.out2) { DSCore.List.Flatten(([l[0]]),1); }
nullToEmptyList = WombatDynamo.List.NullToEmptyList(data=code_block_27)
byLevel = StructuralPlanView.ByLevel(level=nullToEmptyList)
code_block_28 = CodeBlock { "Zona"; }
code_block_29 = CodeBlock(l=code_block_26.out2) { DSCore.String.ToUpper(DSCore.List.Flatten(([l[2]]),1)); }
setParameterByName = Element.SetParameterByName(element=byLevel, parameterName=code_block_28, value=code_block_29, lacing=Longest)
view_family_types_ᶜᵒⁿᵛᵉʳᵗᵉᵈ_2 = CodeBlock()  # "View Family Types ⁽ᶜᵒⁿᵛᵉʳᵗᵉᵈ ᵈʳᵒᵖᵈᵒʷⁿ⁾"
# ---------- view_family_types_ᶜᵒⁿᵛᵉʳᵗᵉᵈ_2.designscript (3 lines) ----------
//Structural Plan (Piso);
Revit.Elements.ElementSelector.ByElementId(92026);
"Type";
# ----------------------------------------
setParameterByName_2 = Element.SetParameterByName(element=setParameterByName, parameterName=view_family_types_ᶜᵒⁿᵛᵉʳᵗᵉᵈ_2.out1, value=view_family_types_ᶜᵒⁿᵛᵉʳᵗᵉᵈ_2.out0)
code_block_30 = CodeBlock(l=code_block_26.out2) { DSCore.List.Flatten(([l[1]]),1); }
nullToEmptyList_2 = WombatDynamo.List.NullToEmptyList(data=code_block_30)
setScale = View.SetScale(view=setParameterByName_2, scale=nullToEmptyList_2, lacing=Longest)
code_block_31 = CodeBlock { null; }
replaceEmptyLists_2 = Custom[List.ReplaceEmptyLists](seq=setScale, Replacement=code_block_31)
all_2 = Orchid.RevitProject.Views.ViewTemplate.InDocument()  # "ViewTemplate.All"
flatten = List.Flatten(list=all_2.ViewTemplate)
name_2 = Element.Name(element=flatten)
code_block_32 = CodeBlock { "Structural Foundation Plan"; }
eq_4 = name_2 == code_block_32
filterByBoolMask_4 = List.FilterByBoolMask(list=flatten, mask=eq_4)
code_block_33 = CodeBlock(x=replaceEmptyLists_2, y=filterByBoolMask_4.in)
# ---------- code_block_33.designscript (14 lines) ----------
x;
y;

[Imperative]
{
	if (x == null)
		{
		return = [];
		}
	else
		{
		return = y;
		}
};
# ----------------------------------------
code_block_34 = CodeBlock(x=setScale) { esc = DSCore.List.UniqueItems(x.GetParameterValueByName("Zona")); "01_ENTREGABLE_01_LO_STRUCTURAL PLAN (PISO)_"+esc; }
duplicate = Orchid.RevitProject.Views.ViewTemplate.Duplicate(viewTemplate=code_block_33.out2, name=code_block_34.out1)
code_block_35 = CodeBlock(esc=code_block_34.esc)
# ---------- code_block_35.designscript (13 lines) ----------
DSCore.List.Flatten(
[
"Clasificacion",
"Subclasificacion",
"Zona"
]);

DSCore.List.Flatten(
[
"01_ENTREGABLE",
"01_LO",
esc
]);
# ----------------------------------------
setParameterByName_3 = Element.SetParameterByName(element=duplicate, parameterName=code_block_35.out0, value=code_block_35.out1, lacing=Longest)
uniqueItems_2 = List.UniqueItems(list=setParameterByName_3)
code_block_36 = CodeBlock { null; }
replaceEmptyLists_3 = Custom[List.ReplaceEmptyLists](seq=uniqueItems_2, Replacement=code_block_36)
code_block_37 = CodeBlock { null; }
replaceEmptyLists_4 = Custom[List.ReplaceEmptyLists](seq=setParameterByName_3, Replacement=code_block_37)
code_block_38 = CodeBlock(x=replaceEmptyLists_4)
# ---------- code_block_38.designscript (13 lines) ----------
x;

[Imperative]
{
	if (x == null)
		{
		return = [[]];
		}
	else
		{
		return = x;
		}
};
# ----------------------------------------
code_block_39 = CodeBlock(a=code_block_38.out1) { esc = DSCore.List.UniqueItems(a.GetParameterValueByName("Zona"))[0]; "Zona"; "NotEquals"; esc; "01_LO_"+esc; }
code_block_40 = CodeBlock(x=replaceEmptyLists_3, y=code_block_39.out4)  # same code as code_block_33
create = Orchid.RevitProject.Filters.FilterRule.Create(parameter=code_block_39.out1, ruleType=code_block_39.out2, value=code_block_39.out3)
code_block_41 = CodeBlock { "Sections"; }
byName_2 = Category.ByName(name=code_block_41)
byRule = Orchid.RevitProject.Filters.ParameterFilter.Create(name=code_block_40.out2@L1, filterRule=create@L2, category=byName_2@L1, lacing=Longest)  # "ParameterFilter.ByRule"
code_block_42 = CodeBlock { false; }
addFilter = Orchid.RevitProject.Views.View.AddFilter(view=uniqueItems_2, parameterFilter=byRule, visibility=code_block_42, lacing=Longest)
set = Orchid.RevitProject.Views.ViewTemplate.Set(view=setScale, viewTemplate=addFilter, lacing=Longest)
code_block_43 = CodeBlock { "View Name"; }
identity = Object.Identity(object=set)
code_block_44 = CodeBlock()
# ---------- code_block_44.designscript (4 lines) ----------
[
"Type",
"Subclasificacion"
];
# ----------------------------------------
getParameterValueByName_4 = Element.GetParameterValueByName(element=identity@L1, parameterName=code_block_44@L2, lacing=Longest)
code_block_45 = CodeBlock { null; }
replaceEmptyLists_5 = Custom[List.ReplaceEmptyLists](seq=getParameterValueByName_4, Replacement=code_block_45)
code_block_46 = CodeBlock(x=replaceEmptyLists_5, y=getParameterValueByName_4)
# ---------- code_block_46.designscript (14 lines) ----------
x;
y;

[Imperative]
{
	if (x == null)
		{
		return = [null,null];
		}
	else
		{
		return = y;
		}
};
# ----------------------------------------
code_block_47 = CodeBlock { 1; }
getItemAtIndex_2 = List.GetItemAtIndex(list=code_block_46.out2@L2, index=code_block_47)
code_block_48 = CodeBlock { "_"; }
code_block_49 = CodeBlock { 0; }
getItemAtIndex_3 = List.GetItemAtIndex(list=code_block_46.out2@L2, index=code_block_49)
nullToEmptyList_3 = WombatDynamo.List.NullToEmptyList(data=getItemAtIndex_3)
name_3 = Element.Name(element=nullToEmptyList_3)
code_block_50 = CodeBlock { 0; 17; }
remove = String.Remove(string=name_3, startIndex=code_block_50.out0, count=code_block_50.out1)
code_block_51 = CodeBlock { ")"; ""; }
replace = String.Replace(string=remove, searchFor=code_block_51.out0, replaceWith=code_block_51.out1)
toUpper = String.ToUpper(string=replace)
name_4 = Element.Name(element=identity)
code_block_52 = CodeBlock { "Zona"; }
getParameterValueByName_5 = Element.GetParameterValueByName(element=identity, parameterName=code_block_52)
list_create_3 = List.Create(item0=getItemAtIndex_2, item1=toUpper, item2=name_4, item3=getParameterValueByName_5)
transpose = List.Transpose(lists=list_create_3)
join = String.Join(separator=code_block_48, string0=transpose@L2)
code_block_53 = CodeBlock(x=getItemAtIndex_2, y=join)
# ---------- code_block_53.designscript (14 lines) ----------
x;
y;

[Imperative]
{
	if (x[0] == null)
		{
		return = [];
		}
	else
		{
		return = y;
		}
};
# ----------------------------------------
code_block_54 = CodeBlock { 0; 3; }
remove_2 = String.Remove(string=code_block_53.out2, startIndex=code_block_54.out0, count=code_block_54.out1)
setParameterByName_4 = Element.SetParameterByName(element=set, parameterName=code_block_43, value=remove_2)
element_level = Custom[Element Level](element=setParameterByName_4)  # package Genius Loci; Gets an element's level. Based on a Clockwork's node
code_block_55 = CodeBlock { 750; -1500; }
set_viewrange = Custom[Set ViewRange](view=setParameterByName_4, TopLevel=element_level, Top=code_block_55.out0, CutLevel=element_level, CutPlane=code_block_55.out0, BottomLevel=element_level, Bottom=code_block_55.out1, DepthLevel=element_level, ViewDepth=code_block_55.out1, lacing=Longest)  # package Genius Loci; Set the view range of the given plan view.
code_block_56 = CodeBlock { "Title on Sheet"; }
name_5 = Element.Name(element=set_viewrange)
code_block_57 = CodeBlock { "_"; }
split_2 = String.Split(string=name_5, separator0=code_block_57)
code_block_58 = CodeBlock { null; }
replaceEmptyLists_6 = Custom[List.ReplaceEmptyLists](seq=split_2, Replacement=code_block_58)
code_block_59 = CodeBlock(x=replaceEmptyLists_6, y=split_2)
# ---------- code_block_59.designscript (14 lines) ----------
x;
y;

[Imperative]
{
	if (x == null)
		{
		return = [null,null,null,null];
		}
	else
		{
		return = y;
		}
};
# ----------------------------------------
code_block_60 = CodeBlock { 2; }
getItemAtIndex_4 = List.GetItemAtIndex(list=code_block_59.out2@L2, index=code_block_60)
code_block_61 = CodeBlock(nivel=getItemAtIndex_4) { title = "PLANTA FUNDACION "+nivel; }
setParameterByName_5 = Element.SetParameterByName(element=set_viewrange, parameterName=code_block_56, value=code_block_61)
viewlevel = Custom[© ViewLevel](views=setParameterByName_5)  # package Crumple; Returns the associated level of a view (if it has one), as well as a boolean mask to remove views without levels after.
byLevel_2 = StructuralPlanView.ByLevel(level=viewlevel.lvls)
code_block_62 = CodeBlock { "Zona"; }
code_block_63 = CodeBlock { null; }
replaceEmptyLists_7 = Custom[List.ReplaceEmptyLists](seq=setParameterByName_5, Replacement=code_block_63)
code_block_64 = CodeBlock(x=replaceEmptyLists_7)  # same code as code_block_38
code_block_65 = CodeBlock(x=code_block_64.out1) { DSCore.List.UniqueItems(x.GetParameterValueByName("Zona"))[0]; }
setParameterByName_6 = Element.SetParameterByName(element=byLevel_2, parameterName=code_block_62, value=code_block_65, lacing=Longest)
view_family_types_ᶜᵒⁿᵛᵉʳᵗᵉᵈ_3 = CodeBlock()  # "View Family Types ⁽ᶜᵒⁿᵛᵉʳᵗᵉᵈ ᵈʳᵒᵖᵈᵒʷⁿ⁾"
# ---------- view_family_types_ᶜᵒⁿᵛᵉʳᵗᵉᵈ_3.designscript (3 lines) ----------
//Structural Plan (Cielo);
Revit.Elements.ElementSelector.ByElementId(204495);
"Type";
# ----------------------------------------
setParameterByName_7 = Element.SetParameterByName(element=setParameterByName_6, parameterName=view_family_types_ᶜᵒⁿᵛᵉʳᵗᵉᵈ_3.out1, value=view_family_types_ᶜᵒⁿᵛᵉʳᵗᵉᵈ_3.out0, lacing=Longest)
scale = Custom[View.Scale](view=setParameterByName_5)  # package Clockwork for Dynamo 2.x; Returns the scale of a given view
code_block_66 = CodeBlock(l=scale)
# ---------- code_block_66.designscript (13 lines) ----------
l;

[Imperative]
{
	if (l == [])
		{
		return = [[]];
		}
	else
		{
		return = l[0];
		}
};
# ----------------------------------------
setScale_2 = View.SetScale(view=setParameterByName_7, scale=code_block_66.out1)
code_block_67 = CodeBlock { null; }
replaceEmptyLists_8 = Custom[List.ReplaceEmptyLists](seq=setParameterByName_7, Replacement=code_block_67)
o_viewtemplate_all = Orchid.RevitProject.Views.ViewTemplate.InDocument()
flatten_2 = List.Flatten(list=o_viewtemplate_all.ViewTemplate)
name_6 = Element.Name(element=flatten_2)
code_block_68 = CodeBlock { "Architectural Reflected Ceiling Plan"; }
eq_5 = name_6 == code_block_68
filterByBoolMask_5 = List.FilterByBoolMask(list=flatten_2, mask=eq_5)
code_block_69 = CodeBlock(x=replaceEmptyLists_8, y=filterByBoolMask_5.in)  # same code as code_block_33
code_block_70 = CodeBlock(x=replaceEmptyLists_8)  # same code as code_block_38
code_block_71 = CodeBlock(x=code_block_70.out1) { "01_LO_"+DSCore.List.UniqueItems(x.GetParameterValueByName("Zona"))[0]; }
code_block_72 = CodeBlock(esc=code_block_71) { "01_ENTREGABLE_01_LO_STRUCTURAL PLAN (CIELO)_"+esc; }
duplicate_2 = Orchid.RevitProject.Views.ViewTemplate.Duplicate(viewTemplate=code_block_69.out2, name=code_block_72)
code_block_73 = CodeBlock(esc=code_block_71)  # same code as code_block_35
setParameterByName_8 = Element.SetParameterByName(element=duplicate_2, parameterName=code_block_73.out0, value=code_block_73.out1, lacing=Longest)
uniqueItems_3 = List.UniqueItems(list=setParameterByName_8)
await_ = Orchid.Common.DataStream.Await(pass=code_block_71, waitFor=setScale_2)
byName_3 = Orchid.RevitProject.Filters.ParameterFilter.ByName(name=await_)
code_block_74 = CodeBlock { false; }
addFilter_2 = Orchid.RevitProject.Views.View.AddFilter(view=uniqueItems_3, parameterFilter=byName_3, visibility=code_block_74, lacing=Longest)
set_2 = Orchid.RevitProject.Views.ViewTemplate.Set(view=setScale_2, viewTemplate=addFilter_2, lacing=Longest)
element_level_2 = Custom[Element Level](element=set_2)
levelAbove = Custom[Level.LevelAbove](level=element_level_2)  # package archi-lab.net; This node takes an input of level and returns level above it.
empty = List.Empty()
replacenulls = Custom[© ReplaceNulls](lst=levelAbove, replace=empty)  # package Crumple; Replaces all nulls with a given substitute.
code_block_75 = CodeBlock { 1000; 300; }
set_viewrange_2 = Custom[Set ViewRange](view=set_2, TopLevel=replacenulls, Top=code_block_75.out1, CutLevel=element_level_2, CutPlane=code_block_75.out0, BottomLevel=element_level_2, Bottom=code_block_75.out0, DepthLevel=replacenulls, ViewDepth=code_block_75.out1, lacing=Longest)
code_block_76 = CodeBlock { "View Name"; }
identity_2 = Object.Identity(object=set_viewrange_2)
code_block_77 = CodeBlock()  # same code as code_block_44
getParameterValueByName_6 = Element.GetParameterValueByName(element=identity_2@L1, parameterName=code_block_77@L2, lacing=Longest)
code_block_78 = CodeBlock { null; }
replaceEmptyLists_9 = Custom[List.ReplaceEmptyLists](seq=getParameterValueByName_6, Replacement=code_block_78)
code_block_79 = CodeBlock(x=replaceEmptyLists_9, y=getParameterValueByName_6)  # same code as code_block_46
code_block_80 = CodeBlock { 1; }
getItemAtIndex_5 = List.GetItemAtIndex(list=code_block_79.out2@L2, index=code_block_80)
code_block_81 = CodeBlock { "_"; }
code_block_82 = CodeBlock { 0; }
getItemAtIndex_6 = List.GetItemAtIndex(list=code_block_79.out2@L2, index=code_block_82)
nullToEmptyList_4 = WombatDynamo.List.NullToEmptyList(data=getItemAtIndex_6)
name_7 = Element.Name(element=nullToEmptyList_4)
code_block_83 = CodeBlock { 0; 17; }
remove_3 = String.Remove(string=name_7, startIndex=code_block_83.out0, count=code_block_83.out1)
code_block_84 = CodeBlock { ")"; ""; }
replace_2 = String.Replace(string=remove_3, searchFor=code_block_84.out0, replaceWith=code_block_84.out1)
toUpper_2 = String.ToUpper(string=replace_2)
name_8 = Element.Name(element=identity_2)
code_block_85 = CodeBlock { "Zona"; }
getParameterValueByName_7 = Element.GetParameterValueByName(element=identity_2, parameterName=code_block_85)
list_create_4 = List.Create(item0=getItemAtIndex_5, item1=toUpper_2, item2=name_8, item3=getParameterValueByName_7)
transpose_2 = List.Transpose(lists=list_create_4)
join_2 = String.Join(separator=code_block_81, string0=transpose_2@L2)
code_block_86 = CodeBlock(x=getItemAtIndex_5, y=join_2)  # same code as code_block_53
code_block_87 = CodeBlock { 0; 3; }
remove_4 = String.Remove(string=code_block_86.out2, startIndex=code_block_87.out0, count=code_block_87.out1)
code_block_88 = CodeBlock { null; }
replaceEmptyLists_10 = Custom[List.ReplaceEmptyLists](seq=remove_4, Replacement=code_block_88)
code_block_89 = CodeBlock(l=replaceEmptyLists_10)
# ---------- code_block_89.designscript (13 lines) ----------
l;

[Imperative]
{
	if (l == null)
		{
		return = null;
		}
	else
		{
		return = l;
		}
};
# ----------------------------------------
setParameterByName_9 = Element.SetParameterByName(element=set_viewrange_2, parameterName=code_block_76, value=code_block_89.out1, lacing=Longest)
code_block_90 = CodeBlock { "Title on Sheet"; }
code_block_91 = CodeBlock { "PLANTA LOSA CIELO "; }
name_9 = Element.Name(element=setParameterByName_9)
code_block_92 = CodeBlock { "_"; }
split_3 = String.Split(string=name_9, separator0=code_block_92)
code_block_93 = CodeBlock { null; }
replaceEmptyLists_11 = Custom[List.ReplaceEmptyLists](seq=split_3, Replacement=code_block_93)
code_block_94 = CodeBlock { 2; }
getItemAtIndex_7 = List.GetItemAtIndex(list=replaceEmptyLists_11@L2, index=code_block_94)
add = code_block_91 + getItemAtIndex_7  # lacing=Longest
setParameterByName_10 = Element.SetParameterByName(element=setParameterByName_9, parameterName=code_block_90, value=add)
name_10 = Element.Name(element=setParameterByName_10)
code_block_95 = CodeBlock { ["_ASUP","_AINF"]; }
add_2 = name_10@L1 + code_block_95@L2  # lacing=Longest
element_duplicate = Custom[Element Duplicate](element=setParameterByName_10@L1, name=add_2@L2, lacing=Longest)  # package Genius Loci; Duplicates the given element (view, element type).
code_block_96 = CodeBlock { "Title on Sheet"; }
code_block_97 = CodeBlock { "Title on Sheet"; }
getParameterValueByName_8 = Element.GetParameterValueByName(element=element_duplicate, parameterName=code_block_97)
code_block_98 = CodeBlock { "_"; }
split_4 = String.Split(string=add_2@L2, separator0=code_block_98)
code_block_99 = CodeBlock { null; }
replaceEmptyLists_12 = Custom[List.ReplaceEmptyLists](seq=split_4, Replacement=code_block_99)
lastItem = List.LastItem(list=replaceEmptyLists_12@@L2)
code_block_100 = CodeBlock(a=getParameterValueByName_8, b=lastItem) { a+", "+b; }
setParameterByName_11 = Element.SetParameterByName(element=element_duplicate, parameterName=code_block_96, value=code_block_100)
flatten_3 = List.Flatten(list=setParameterByName_11)
get = Orchid.RevitProject.Views.ViewTemplate.Get(view=setParameterByName_10)
uniqueItems_4 = List.UniqueItems(list=get)
set_3 = Orchid.RevitProject.Views.ViewTemplate.Set(view=flatten_3, viewTemplate=uniqueItems_4, lacing=Longest)
code_block_101 = CodeBlock()
# ---------- code_block_101.designscript (4 lines) ----------
[
"Subclasificacion",
"Zona"
];
# ----------------------------------------
getParameterValueByName_9 = Element.GetParameterValueByName(element=set_3, parameterName=code_block_101)
uniqueItems_5 = List.UniqueItems(list=getParameterValueByName_9)
code_block_102 = CodeBlock { null; }
replaceEmptyLists_13 = Custom[List.ReplaceEmptyLists](seq=uniqueItems_5, Replacement=code_block_102)
code_block_103 = CodeBlock(x=replaceEmptyLists_13)
# ---------- code_block_103.designscript (13 lines) ----------
x;

[Imperative]
{
	if (x == null)
		{
		return = [[],[]];
		}
	else
		{
		return = x;
		}
};
# ----------------------------------------
all_3 = Orchid.RevitProject.Views.ViewTemplate.InDocument()  # "ViewTemplate.All"
flatten_4 = List.Flatten(list=all_3.ViewTemplate)
name_11 = Element.Name(element=flatten_4)
code_block_104 = CodeBlock { "Architectural Section"; }
eq_6 = name_11 == code_block_104
filterByBoolMask_6 = List.FilterByBoolMask(list=flatten_4, mask=eq_6)
code_block_105 = CodeBlock(x=code_block_103.out1, y=filterByBoolMask_6.in)
# ---------- code_block_105.designscript (15 lines) ----------
x[0];
x[1];
y;

[Imperative]
{
	if (x == null)
		{
		return = [];
		}
	else
		{
		return = y;
		}
};
# ----------------------------------------
code_block_106 = CodeBlock(esc=code_block_105.out1) { "01_ENTREGABLE_01_LO_BUILDING SECTION_"+esc; }
duplicate_3 = Orchid.RevitProject.Views.ViewTemplate.Duplicate(viewTemplate=code_block_105.out3, name=code_block_106)
code_block_107 = CodeBlock(x=code_block_103.out1)
# ---------- code_block_107.designscript (13 lines) ----------
x;

[Imperative]
{
	if (x == null)
		{
		return = [];
		}
	else
		{
		return = x;
		}
};
# ----------------------------------------
code_block_108 = CodeBlock(lst=code_block_107.out1)
# ---------- code_block_108.designscript (15 lines) ----------
lst;

[
"Clasificacion",
"Subclasificacion",
"Zona",
"Discipline"
];

[
"01_ENTREGABLE",
lst[0],
lst[1],
2
];
# ----------------------------------------
setParameterByName_12 = Element.SetParameterByName(element=duplicate_3, parameterName=code_block_108.out1, value=code_block_108.out2, lacing=Longest)
uniqueItems_6 = List.UniqueItems(list=setParameterByName_12)
code_block_109 = CodeBlock(esc=code_block_105.out1) { "01_LO_"+esc; }
await_2 = Orchid.Common.DataStream.Await(pass=code_block_109, waitFor=uniqueItems_6)
byName_4 = Orchid.RevitProject.Filters.ParameterFilter.ByName(name=await_2)
code_block_110 = CodeBlock { false; }
addFilter_3 = Orchid.RevitProject.Views.View.AddFilter(view=uniqueItems_6, parameterFilter=byName_4, visibility=code_block_110, lacing=Longest)
end = Revit.Transaction.Transaction.End(input=addFilter_3)
await_3 = Orchid.Common.DataStream.Await(pass=code_block_105.out1, waitFor=end)
code_block_111 = CodeBlock(esc=await_3) { "Building Section (01_LO_"+esc+")"; }
duplicate_4 = archilab.Revit.Elements.ElementTypes.Duplicate(element=view_family_types_ᶜᵒⁿᵛᵉʳᵗᵉᵈ, name=code_block_111)
code_block_112 = CodeBlock { "View Template applied to new views"; }
setParameterByName_13 = Element.SetParameterByName(element=duplicate_4, parameterName=code_block_112, value=end)
view_family_types_ᶜᵒⁿᵛᵉʳᵗᵉᵈ_4 = CodeBlock()  # "View Family Types ⁽ᶜᵒⁿᵛᵉʳᵗᵉᵈ ᵈʳᵒᵖᵈᵒʷⁿ⁾"
# ---------- view_family_types_ᶜᵒⁿᵛᵉʳᵗᵉᵈ_4.designscript (2 lines) ----------
//Detail;
Revit.Elements.ElementSelector.ByElementId(69335);
# ----------------------------------------
all_4 = Orchid.RevitProject.Views.ViewTemplate.InDocument()  # "ViewTemplate.All"
flatten_5 = List.Flatten(list=all_4.ViewTemplate)
name_12 = Element.Name(element=flatten_5)
code_block_113 = CodeBlock { "Architectural Detail"; }
eq_7 = name_12 == code_block_113
filterByBoolMask_7 = List.FilterByBoolMask(list=flatten_5, mask=eq_7)
code_block_114 = CodeBlock(x=code_block_103.out1, y=filterByBoolMask_7.in)  # same code as code_block_105
code_block_115 = CodeBlock(esc=code_block_114.out1) { "01_ENTREGABLE_01_LO_DETAIL_"+esc; }
duplicate_5 = Orchid.RevitProject.Views.ViewTemplate.Duplicate(viewTemplate=code_block_114.out3, name=code_block_115)
code_block_116 = CodeBlock(x=code_block_103.out1)  # same code as code_block_107
code_block_117 = CodeBlock(lst=code_block_116.out1)  # same code as code_block_108
setParameterByName_14 = Element.SetParameterByName(element=duplicate_5, parameterName=code_block_117.out1, value=code_block_117.out2, lacing=Longest)
uniqueItems_7 = List.UniqueItems(list=setParameterByName_14)
code_block_118 = CodeBlock(esc=code_block_114.out1) { "01_LO_"+esc; }
await_4 = Orchid.Common.DataStream.Await(pass=code_block_118, waitFor=uniqueItems_7)
byName_5 = Orchid.RevitProject.Filters.ParameterFilter.ByName(name=await_4)
code_block_119 = CodeBlock { false; }
addFilter_4 = Orchid.RevitProject.Views.View.AddFilter(view=uniqueItems_7, parameterFilter=byName_5, visibility=code_block_119, lacing=Longest)
end_2 = Revit.Transaction.Transaction.End(input=addFilter_4)
await_5 = Orchid.Common.DataStream.Await(pass=code_block_114.out1, waitFor=end_2)
code_block_120 = CodeBlock(esc=await_5) { "Detail (01_LO_"+esc+")"; }
duplicate_6 = archilab.Revit.Elements.ElementTypes.Duplicate(element=view_family_types_ᶜᵒⁿᵛᵉʳᵗᵉᵈ_4, name=code_block_120)
code_block_121 = CodeBlock { "View Template applied to new views"; }
setParameterByName_15 = Element.SetParameterByName(element=duplicate_6, parameterName=code_block_121, value=end_2)
code_block_122 = CodeBlock(x=setParameterByName_5) { x; }
await_6 = Orchid.Common.DataStream.Await(pass=code_block_122, waitFor=byLevel_2)
view_level = Custom[View Level](view=await_6)  # package Genius Loci; Returns the level to which a view is associated.
elevation_2 = Level.Elevation(level=view_level)
minimumItem = List.MinimumItem(list=elevation_2)
eq_8 = elevation_2 == minimumItem
filterByBoolMask_8 = List.FilterByBoolMask(list=await_6, mask=eq_8)
await_7 = Orchid.Common.DataStream.Await(pass=setParameterByName_10, waitFor=set_3)
delete = archilab.Revit.Elements.Elements.Delete(element=await_7)
