# Dynamo graph PlantasMA_script.dyn (Dynamo 2.16.1.2727)
# packages: Data-Shapes 2022.2.96, WombatDynamo 2.3.4, Genius Loci 2020.8.3, Crumple 2022.2.13, archi-lab.net 2022.210.2419, Orchid 200.4.0.7938, Data-Shapes 2021.2.94, Clockwork for Dynamo 2.x 2.4.0

boolean = BoolSelector(false)
view_family_types_ᶜᵒⁿᵛᵉʳᵗᵉᵈ = CodeBlock()  # "View Family Types ⁽ᶜᵒⁿᵛᵉʳᵗᵉᵈ ᵈʳᵒᵖᵈᵒʷⁿ⁾"
# ---------- view_family_types_ᶜᵒⁿᵛᵉʳᵗᵉᵈ.designscript (2 lines) ----------
//Detail;
Revit.Elements.ElementSelector.ByElementId(69335);
# ----------------------------------------
code_block = CodeBlock { "Detail (02_MA)"; }
duplicate = archilab.Revit.Elements.ElementTypes.Duplicate(element=view_family_types_ᶜᵒⁿᵛᵉʳᵗᵉᵈ, name=code_block)
code_block_2 = CodeBlock { "View Template applied to new views"; }
code_block_3 = CodeBlock { "Planta Ubicacion Elev. por Eje - MA"; }
code_block_4 = CodeBlock { "INICIAR"; "CANCELAR"; 100; 450; }
code_block_5 = CodeBlock { "Niveles"; }
code_block_6 = CodeBlock { "Levels"; }
byName = Category.ByName(name=code_block_6)
all_elements_of_category = ElementsOfCategory(Category=byName)
elevation = Level.Elevation(level=all_elements_of_category)
sortByKey = List.SortByKey(list=all_elements_of_category, keys=elevation)
code_block_7 = CodeBlock { "Building Story"; }
getParameterValueByName = Element.GetParameterValueByName(element=sortByKey.sortedList, parameterName=code_block_7)
code_block_8 = CodeBlock { 1; }
eq = getParameterValueByName == code_block_8
filterByBoolMask = List.FilterByBoolMask(list=sortByKey.sortedList, mask=eq)
name = Element.Name(element=filterByBoolMask.in)
code_block_9 = CodeBlock { 430; false; true; }
code_block_10 = CodeBlock(l=name) { count = DSCore.List.Count(l) - 1; 0..count..1; }
listview_data = Custom[Listview Data](InputName=code_block_5, Keys=name, Values=filterByBoolMask.in, Height_optionnal=code_block_9.out0, ShowElementCount_optionnal=code_block_9.out2, DefaultValueIndices_optionnal=code_block_10.out1, SortItems_optionnal=code_block_9.out1, ShowId_optionnal=code_block_9.out1)  # package Data-Shapes; Create data for ListView input in UI.MultiInputForm ++ . Check out www.data-shapes.net for more infos.
code_block_11 = CodeBlock { "Escala"; }
code_block_12 = CodeBlock()
# ---------- code_block_12.designscript (10 lines) ----------
[
"1:50",
"1:75",
"1:100",
"1:125",
"1:150",
"1:175",
"1:200"
];
":";
# ----------------------------------------
split = String.Split(string=code_block_12.out0, separator0=code_block_12.out1)
code_block_13 = CodeBlock { 1; }
getItemAtIndex = List.GetItemAtIndex(list=split@L2, index=code_block_13)
toNumber = String.ToNumber(string=getItemAtIndex)
code_block_14 = CodeBlock { 0; false; }
dropdown_data = Custom[DropDown Data](InputName=code_block_11, Keys=code_block_12.out0, Values=toNumber, DefaultValueIndex=code_block_14.out0, Sorted_optional=code_block_14.out1)  # package Data-Shapes; Create data for DropDown input in UI.MultiInputForm ++ . Check out www.data-shapes.net for more infos.
list_create = List.Create(item0=listview_data, item1=dropdown_data)
all = Orchid.RevitProject.Views.View.InDocument()  # "View.All"
code_block_15 = CodeBlock { "Subclasificacion"; }
getParameterValueByName_2 = Element.GetParameterValueByName(element=all, parameterName=code_block_15)
code_block_16 = CodeBlock { "02_MA"; }
eq_2 = getParameterValueByName_2 == code_block_16
filterByBoolMask_2 = List.FilterByBoolMask(list=all, mask=eq_2)
isEmpty = List.IsEmpty(list=filterByBoolMask_2.in)
multipleinputform = Custom[MultipleInputForm ++](Description_optional=code_block_3, ButtonText_optional=code_block_4.out0, Inputs=list_create, Toggle=isEmpty, CancelButtonText_optional=code_block_4.out1, Width_optional=code_block_4.out3, LabelWidth_optional=code_block_4.out2)  # package Data-Shapes; Create a form with multiple inputs. see www.data-shapes.net for tutorials and infos!
code_block_17 = CodeBlock(l=multipleinputform.User_Inputs)
# ---------- code_block_17.designscript (16 lines) ----------
l;
[Imperative]
{
	if (l == null)
		{
		return = [[],[]];
		}
	elseif (l[0] == "Set toggle to true!")
		{
		return = [[],[]];
		}
	else
		{
		return = l;
		}
};
# ----------------------------------------
code_block_18 = CodeBlock(l=code_block_17.out1) { DSCore.List.Flatten(([l[0]]),1); }
nullToEmptyList = WombatDynamo.List.NullToEmptyList(data=code_block_18)
byLevel = StructuralPlanView.ByLevel(level=nullToEmptyList)
code_block_19 = CodeBlock { "Zona"; "GENERAL"; }
setParameterByName = Element.SetParameterByName(element=byLevel, parameterName=code_block_19.out0, value=code_block_19.out1)
view_family_types_ᶜᵒⁿᵛᵉʳᵗᵉᵈ_2 = CodeBlock()  # "View Family Types ⁽ᶜᵒⁿᵛᵉʳᵗᵉᵈ ᵈʳᵒᵖᵈᵒʷⁿ⁾"
# ---------- view_family_types_ᶜᵒⁿᵛᵉʳᵗᵉᵈ_2.designscript (3 lines) ----------
//Structural Plan (Cielo);
Revit.Elements.ElementSelector.ByElementId(204495);
"Type";
# ----------------------------------------
setParameterByName_2 = Element.SetParameterByName(element=setParameterByName, parameterName=view_family_types_ᶜᵒⁿᵛᵉʳᵗᵉᵈ_2.out1, value=view_family_types_ᶜᵒⁿᵛᵉʳᵗᵉᵈ_2.out0)
code_block_20 = CodeBlock(l=code_block_17.out1) { DSCore.List.Flatten(([l[1]]),1); }
nullToEmptyList_2 = WombatDynamo.List.NullToEmptyList(data=code_block_20)
setScale = View.SetScale(view=setParameterByName_2, scale=nullToEmptyList_2, lacing=Longest)
code_block_21 = CodeBlock { null; }
replaceEmptyLists = Custom[List.ReplaceEmptyLists](seq=setScale, Replacement=code_block_21)  # package Clockwork for Dynamo 2.x; Replaces all empty lists within a given list with a substitute
all_2 = Orchid.RevitProject.Views.ViewTemplate.InDocument()  # "ViewTemplate.All"
flatten = List.Flatten(list=all_2.ViewTemplate)
name_2 = Element.Name(element=flatten)
code_block_22 = CodeBlock { "Architectural Reflected Ceiling Plan"; }
eq_3 = name_2 == code_block_22
filterByBoolMask_3 = List.FilterByBoolMask(list=flatten, mask=eq_3)
code_block_23 = CodeBlock(x=replaceEmptyLists, y=filterByBoolMask_3.in)
# ---------- code_block_23.designscript (14 lines) ----------
x;
y;

[Imperative]
{
	if (x == null)
		{
		return = [];
		}
	else
		{
		return = y;
		}
};
# ----------------------------------------
code_block_24 = CodeBlock { "01_ENTREGABLE_02_MA_STRUCTURAL PLAN (CIELO)"; }
duplicate_2 = Orchid.RevitProject.Views.ViewTemplate.Duplicate(viewTemplate=code_block_23.out2, name=code_block_24)
code_block_25 = CodeBlock()
# ---------- code_block_25.designscript (4 lines) ----------
[
"Clasificacion",
"Subclasificacion"
];
# ----------------------------------------
code_block_26 = CodeBlock { "01_ENTREGABLE"; "02_MA"; }
list_create_2 = List.Create(item0=code_block_26.out0, item1=code_block_26.out1)
setParameterByName_3 = Element.SetParameterByName(element=duplicate_2, parameterName=code_block_25, value=list_create_2, lacing=Longest)
uniqueItems = List.UniqueItems(list=setParameterByName_3)
code_block_27 = CodeBlock { null; }
replaceEmptyLists_2 = Custom[List.ReplaceEmptyLists](seq=uniqueItems, Replacement=code_block_27)
code_block_28 = CodeBlock { "Subclasificacion"; "NotEquals"; "02_MA"; }
code_block_29 = CodeBlock(x=replaceEmptyLists_2, y=code_block_28.out2)  # same code as code_block_23
create = Orchid.RevitProject.Filters.FilterRule.Create(parameter=code_block_28.out0, ruleType=code_block_28.out1, value=code_block_28.out2)
code_block_30 = CodeBlock { "Sections"; }
byName_2 = Category.ByName(name=code_block_30)
byRule = Orchid.RevitProject.Filters.ParameterFilter.Create(name=code_block_29.out2, filterRule=create, category=byName_2)  # "ParameterFilter.ByRule"
code_block_31 = CodeBlock { false; }
addFilter = Orchid.RevitProject.Views.View.AddFilter(view=uniqueItems, parameterFilter=byRule, visibility=code_block_31, lacing=Longest)
set = Orchid.RevitProject.Views.ViewTemplate.Set(view=setScale, viewTemplate=addFilter, lacing=Longest)
code_block_32 = CodeBlock { "View Name"; }
identity = Object.Identity(object=set)
code_block_33 = CodeBlock()
# ---------- code_block_33.designscript (4 lines) ----------
[
"Type",
"Subclasificacion"
];
# ----------------------------------------
getParameterValueByName_3 = Element.GetParameterValueByName(element=identity@L1, parameterName=code_block_33@L2, lacing=Longest)
code_block_34 = CodeBlock { null; }
replaceEmptyLists_3 = Custom[List.ReplaceEmptyLists](seq=getParameterValueByName_3, Replacement=code_block_34)
code_block_35 = CodeBlock(x=replaceEmptyLists_3, y=getParameterValueByName_3)
# ---------- code_block_35.designscript (14 lines) ----------
x;
y;

[Imperative]
{
	if (x == null)
		{
		return = [null,null];
		}
	else
		{
		return = y;
		}
};
# ----------------------------------------
code_block_36 = CodeBlock { 1; }
getItemAtIndex_2 = List.GetItemAtIndex(list=code_block_35.out2@L2, index=code_block_36)
code_block_37 = CodeBlock { "_"; }
code_block_38 = CodeBlock { 0; }
getItemAtIndex_3 = List.GetItemAtIndex(list=code_block_35.out2@L2, index=code_block_38)
nullToEmptyList_3 = WombatDynamo.List.NullToEmptyList(data=getItemAtIndex_3)
name_3 = Element.Name(element=nullToEmptyList_3)
code_block_39 = CodeBlock { 0; 17; }
remove = String.Remove(string=name_3, startIndex=code_block_39.out0, count=code_block_39.out1)
code_block_40 = CodeBlock { ")"; ""; }
replace = String.Replace(string=remove, searchFor=code_block_40.out0, replaceWith=code_block_40.out1)
toUpper = String.ToUpper(string=replace)
name_4 = Element.Name(element=identity)
list_create_3 = List.Create(item0=getItemAtIndex_2, item1=toUpper, item2=name_4)
transpose = List.Transpose(lists=list_create_3)
join = String.Join(separator=code_block_37, string0=transpose@L2)
code_block_41 = CodeBlock(x=getItemAtIndex_2, y=join)
# ---------- code_block_41.designscript (14 lines) ----------
x;
y;

[Imperative]
{
	if (x[0] == null)
		{
		return = [];
		}
	else
		{
		return = y;
		}
};
# ----------------------------------------
code_block_42 = CodeBlock { 0; 3; }
remove_2 = String.Remove(string=code_block_41.out2, startIndex=code_block_42.out0, count=code_block_42.out1)
setParameterByName_4 = Element.SetParameterByName(element=set, parameterName=code_block_32, value=remove_2)
element_level = Custom[Element Level](element=setParameterByName_4)  # package Genius Loci; Gets an element's level. Based on a Clockwork's node
levelAbove = Custom[Level.LevelAbove](level=element_level)  # package archi-lab.net; This node takes an input of level and returns level above it.
empty = List.Empty()
replacenulls = Custom[© ReplaceNulls](lst=levelAbove, replace=empty)  # package Crumple; Replaces all nulls with a given substitute.
code_block_43 = CodeBlock { 1000; 300; }
set_viewrange = Custom[Set ViewRange](view=setParameterByName_4, TopLevel=replacenulls, Top=code_block_43.out1, CutLevel=element_level, CutPlane=code_block_43.out0, BottomLevel=element_level, Bottom=code_block_43.out0, DepthLevel=replacenulls, ViewDepth=code_block_43.out1, lacing=Longest)  # package Genius Loci; Set the view range of the given plan view.
code_block_44 = CodeBlock { "Title on Sheet"; }
name_5 = Element.Name(element=set_viewrange)
code_block_45 = CodeBlock { "_"; }
split_2 = String.Split(string=name_5, separator0=code_block_45)
code_block_46 = CodeBlock { null; }
replaceEmptyLists_4 = Custom[List.ReplaceEmptyLists](seq=split_2, Replacement=code_block_46)
code_block_47 = CodeBlock(x=replaceEmptyLists_4, y=split_2)
# ---------- code_block_47.designscript (14 lines) ----------
x;
y;

[Imperative]
{
	if (x == null)
		{
		return = [null,null,null,null];
		}
	else
		{
		return = y;
		}
};
# ----------------------------------------
code_block_48 = CodeBlock { 2; }
getItemAtIndex_4 = List.GetItemAtIndex(list=code_block_47.out2@L2, index=code_block_48)
code_block_49 = CodeBlock(nivel=getItemAtIndex_4) { "PLANTA LOSA CIELO "+nivel; }
setParameterByName_5 = Element.SetParameterByName(element=set_viewrange, parameterName=code_block_44, value=code_block_49)
flatten_2 = List.Flatten(list=setParameterByName_5)
uniqueItems_2 = List.UniqueItems(list=flatten_2)
code_block_50 = CodeBlock { "Subclasificacion"; }
getParameterValueByName_4 = Element.GetParameterValueByName(element=uniqueItems_2, parameterName=code_block_50)
uniqueItems_3 = List.UniqueItems(list=getParameterValueByName_4)
code_block_51 = CodeBlock { null; }
replaceEmptyLists_5 = Custom[List.ReplaceEmptyLists](seq=uniqueItems_3, Replacement=code_block_51)
all_3 = Orchid.RevitProject.Views.ViewTemplate.InDocument()  # "ViewTemplate.All"
flatten_3 = List.Flatten(list=all_3.ViewTemplate)
name_6 = Element.Name(element=flatten_3)
code_block_52 = CodeBlock { "Architectural Detail"; }
eq_4 = name_6 == code_block_52
filterByBoolMask_4 = List.FilterByBoolMask(list=flatten_3, mask=eq_4)
code_block_53 = CodeBlock(x=replaceEmptyLists_5, y=filterByBoolMask_4.in)  # same code as code_block_23
code_block_54 = CodeBlock { "01_ENTREGABLE_02_MA_DETAIL"; }
duplicate_3 = Orchid.RevitProject.Views.ViewTemplate.Duplicate(viewTemplate=code_block_53.out2, name=code_block_54)
code_block_55 = CodeBlock(x=replaceEmptyLists_5)
# ---------- code_block_55.designscript (13 lines) ----------
x;

[Imperative]
{
	if (x == null)
		{
		return = [];
		}
	else
		{
		return = x[0];
		}
};
# ----------------------------------------
code_block_56 = CodeBlock(tip=code_block_55.out1)
# ---------- code_block_56.designscript (13 lines) ----------
[
"Clasificacion",
"Subclasificacion",
"Zona",
"Discipline"
];

[
"01_ENTREGABLE",
tip,
"GENERAL",
2
];
# ----------------------------------------
setParameterByName_6 = Element.SetParameterByName(element=duplicate_3, parameterName=code_block_56.out0, value=code_block_56.out1, lacing=Longest)
uniqueItems_4 = List.UniqueItems(list=setParameterByName_6)
code_block_57 = CodeBlock { "02_MA"; }
await_ = Orchid.Common.DataStream.Await(pass=code_block_57, waitFor=uniqueItems_4)
byName_3 = Orchid.RevitProject.Filters.ParameterFilter.ByName(name=await_)
code_block_58 = CodeBlock { false; }
addFilter_2 = Orchid.RevitProject.Views.View.AddFilter(view=uniqueItems_4, parameterFilter=byName_3, visibility=code_block_58, lacing=Longest)
end = Revit.Transaction.Transaction.End(input=addFilter_2)
setParameterByName_7 = Element.SetParameterByName(element=duplicate, parameterName=code_block_2, value=end)
code_block_59 = CodeBlock { "Planta Ubicacion Elev. por Eje - MA"; }
code_block_60 = CodeBlock { "OK"; 450; }
code_block_61 = CodeBlock { "Error"; }
code_block_62 = CodeBlock { "Las vistas de esta categoria ya fueron generadas. Para vistas adicionales, duplicar de las ya existentes."; }
textnote_data = Custom[TextNote Data](Title=code_block_61, TextNote=code_block_62)  # package Data-Shapes; Create Data for TextNote input in UI.MultipleInputForm ++ . Check out www.data-shapes.net for more informations
code_block_63 = CodeBlock { false; }
eq_5 = multipleinputform.Was_Run == code_block_63
code_block_64 = CodeBlock { true; false; }
scopeIf = Custom[ScopeIf+](test=eq_5, True=code_block_64.out0, False=code_block_64.out1)  # package Clockwork for Dynamo 2.x; A (hopefully) more robust implementation of ScopeIf. Tests a single boolean and returns a value accordingly.
multipleinputform_2 = Custom[MultipleInputForm ++](Description_optional=code_block_59, ButtonText_optional=code_block_60.out0, Inputs=textnote_data, Toggle=scopeIf, Width_optional=code_block_60.out1)
view_family_types_ᶜᵒⁿᵛᵉʳᵗᵉᵈ_3 = CodeBlock()  # "View Family Types ⁽ᶜᵒⁿᵛᵉʳᵗᵉᵈ ᵈʳᵒᵖᵈᵒʷⁿ⁾"
# ---------- view_family_types_ᶜᵒⁿᵛᵉʳᵗᵉᵈ_3.designscript (2 lines) ----------
//Building Section;
Revit.Elements.ElementSelector.ByElementId(69334);
# ----------------------------------------
code_block_65 = CodeBlock { "Building Section (02_MA)"; }
duplicate_4 = archilab.Revit.Elements.ElementTypes.Duplicate(element=view_family_types_ᶜᵒⁿᵛᵉʳᵗᵉᵈ_3, name=code_block_65)
code_block_66 = CodeBlock { "View Template applied to new views"; }
code_block_67 = CodeBlock { null; }
replaceEmptyLists_6 = Custom[List.ReplaceEmptyLists](seq=uniqueItems_3, Replacement=code_block_67)
all_4 = Orchid.RevitProject.Views.ViewTemplate.InDocument()  # "ViewTemplate.All"
flatten_4 = List.Flatten(list=all_4.ViewTemplate)
name_7 = Element.Name(element=flatten_4)
code_block_68 = CodeBlock { "Architectural Section"; }
eq_6 = name_7 == code_block_68
filterByBoolMask_5 = List.FilterByBoolMask(list=flatten_4, mask=eq_6)
code_block_69 = CodeBlock(x=replaceEmptyLists_6, y=filterByBoolMask_5.in)  # same code as code_block_23
code_block_70 = CodeBlock { "01_ENTREGABLE_02_MA_BUILDING SECTION"; }
duplicate_5 = Orchid.RevitProject.Views.ViewTemplate.Duplicate(viewTemplate=code_block_69.out2, name=code_block_70)
code_block_71 = CodeBlock(x=replaceEmptyLists_6)  # same code as code_block_55
code_block_72 = CodeBlock(tip=code_block_71.out1)  # same code as code_block_56
setParameterByName_8 = Element.SetParameterByName(element=duplicate_5, parameterName=code_block_72.out0, value=code_block_72.out1, lacing=Longest)
uniqueItems_5 = List.UniqueItems(list=setParameterByName_8)
code_block_73 = CodeBlock { "02_MA"; }
await_2 = Orchid.Common.DataStream.Await(pass=code_block_73, waitFor=uniqueItems_5)
byName_4 = Orchid.RevitProject.Filters.ParameterFilter.ByName(name=await_2)
code_block_74 = CodeBlock { false; }
addFilter_3 = Orchid.RevitProject.Views.View.AddFilter(view=uniqueItems_5, parameterFilter=byName_4, visibility=code_block_74, lacing=Longest)
end_2 = Revit.Transaction.Transaction.End(input=addFilter_3)
setParameterByName_9 = Element.SetParameterByName(element=duplicate_4, parameterName=code_block_66, value=end_2)
